# Dynamo graph 02-3BoxVolumeSurfaceArea_edited.dyn (Dynamo 2.2.1.5175)

# group: 3BOX VOLUME SURFACE AREA Refinery Graph Example
# note: DYNAMO PROJECT
# 02-3BoxVolumeSurfaceArea.dyn
# note: ASSOCIATED FILE(S)
# N/A
# note: AUTHOR(S) / CREATION DATE
# Refinery Team / Dec 2018
# note: DESCRIPTION
# This graph contains three Cuboids representing buildings. Cuboid One (C1) has a fixed location, but varies in Height. Cuboid Two (C2) and Cuboid Three (C3) can both vary in Location (Both X and Y directions) as well as Height.
# The graph uses Refinery to find the minimum Volume that correlates with the maximum Surface Area.
# note: DYNAMO VERSION
# 2.0.2
# note: ADDITIONAL COMMENTS
# N/A
# note: REQUIRED DYNAMO PACKAGES
# N/A

# group: Width
c1_width = CodeBlock { 55; }
c2_width = CodeBlock { 45; }
c3_width = CodeBlock { 35; }

# group: Length *2
list_create = List.Create(item0=c1_width, item1=c2_width, item2=c3_width)
double_length = CodeBlock(x=list_create) { 2*x; }
code_block = CodeBlock(l=double_length) { l[0]; }
code_block_2 = CodeBlock(l=double_length) { l[2]; }

# group: Input: Changeable variables
# note: Variables / Inputs
# Red indicates Variables that can be altered per project and must be set accordingly before running the script.
# note: Working / Functions
# Green indicates the working of the script. No changes should be made in these groups unless advised.
# note: NOTE:
# In order to see an 'Input' in Refinery, you have to right-click on a compatible node and check the 'Is Input' option. Rename the node to see a legible input name in Refinery.
c1_height = DoubleSlider(317, range=19..360 step 1)  # graph input
c2_x_location = DoubleSlider(41, range=0..50 step 1)  # graph input
# note: Checking / Outputs
# Orange indicates checking nodes to ensure the script has deployed correctly.
c2_y_location = DoubleSlider(40, range=0..50 step 1)  # graph input
c2_height = DoubleSlider(493, range=20..500 step 1)  # graph input
c3_x_location = DoubleSlider(91, range=0..120 step 1)  # graph input
c3_y_location = DoubleSlider(83, range=20..120 step 1)  # graph input
c3_height = DoubleSlider(332, range=20..350 step 1)  # graph input

code_block_3 = CodeBlock(l=double_length) { l[1]; }

# group: Geometry [Dynamo]: Geometry Manipulation
width = CodeBlock { 55; }
byCoordinates = Point.ByCoordinates()
byLengths = Cuboid.ByLengths(origin=byCoordinates, width=c1_width, length=code_block, height=c1_height)
code_block_4 = CodeBlock(h=c1_height) { h/2; }
translate = Geometry.Translate(geometry=byLengths, zTranslation=code_block_4)
byCoordinates_2 = Point.ByCoordinates(x=c2_x_location, y=c2_y_location)
byLengths_2 = Cuboid.ByLengths(origin=byCoordinates_2, width=c2_width, length=code_block_3, height=c2_height)
code_block_5 = CodeBlock(h=c2_height) { h/2; }
translate_2 = Geometry.Translate(geometry=byLengths_2, zTranslation=code_block_5)
byCoordinates_3 = Point.ByCoordinates(x=c3_x_location, y=c3_y_location)
byLengths_3 = Cuboid.ByLengths(origin=byCoordinates_3, width=c3_width, length=code_block_2, height=c3_height)
code_block_6 = CodeBlock(h=c3_height) { h/2; }
translate_3 = Geometry.Translate(geometry=byLengths_3, zTranslation=code_block_6)
list_create_2 = List.Create(item0=translate, item1=translate_2, item2=translate_3)
byUnion = Solid.ByUnion(solids=list_create_2)

# group: Analysis: Surface Area and Volume
area = Solid.Area(solid=byUnion)
volume = Solid.Volume(solid=byUnion)

# group: Output: Output information that can be used to filter results in Refinery
totalsurfacearea_max = Watch(area)  # graph output
# note: NOTE:
# In order to see an 'Output' in Refinery, you have to right-click on a compatible node and check the 'Is
# Output' option. Rename the node to see a legible output name in Refinery.
totalvolume_min = Watch(volume)  # graph output

# group: Visualization: Colourizes Dynamo geometry in the Background Preview window
color_palette = ColorPalette({R: 255, G: 0, B: 0, A: 255})
byGeometryColor = Modifiers.GeometryColor.ByGeometryColor(geometry=translate_2, color=color_palette)

color_palette_2 = ColorPalette({R: 152, G: 251, B: 152, A: 255})
byGeometryColor_2 = Modifiers.GeometryColor.ByGeometryColor(geometry=translate_3, color=color_palette_2)
color_palette_3 = ColorPalette({R: 30, G: 144, B: 255, A: 255})
byGeometryColor_3 = Modifiers.GeometryColor.ByGeometryColor(geometry=translate, color=color_palette_3)
diference_in_height = CodeBlock(H1=c1_height, H2=c2_height) { (H1-H2); }
difference_in_h1_min = Watch(diference_in_height)  # graph output
diference_in_height_2 = CodeBlock(H2=c2_height, H3=c3_height) { (H2-H3); }
difference_in_h2_min = Watch(diference_in_height_2)  # graph output
