# Dynamo graph Autodesk-MaRS-office-example-v1.dyn (Dynamo 2.2.1.5175)

# note: Variables / Inputs
# Variables that can be altered per project and must be set accordingly before running the script.
# note: Metrics / Goals / Outputs
# Logic associated with calculating goals, metrics, outputs .
# note: Working / Functions
# Core working of the script.
# note: Display / Visualization
# Logic used simply for visualization purposes, and doesn't contain core logic.

# group: MaRS with All Metrics
# note: DYNAMO PROJECT
# spaceanalysis-metrics-MaRS-layout-with-all-metrics.dyn
# note: ASSOCIATED FILE(S)
# N/A
# note: AUTHOR(S) / CREATION DATE
# Autodesk Systems Group / 2019
# note: DESCRIPTION
# Example project description.
# note: DYNAMO VERSION
# 2.0.2, 2.1.0, 2.2.0, 2.3.0
# note: ADDITIONAL COMMENTS
# N/A
# note: REQUIRED DYNAMO PACKAGES
# SpaceAnalysis 0.2.3+
# DynamoText

# group: Create Outer Boundary
code_block = CodeBlock()
# ---------- code_block.designscript (4 lines) ----------
[3.85,-18.938,35.211,-18.849,35.022,-35.469,31.766,-35.444,31.724,-43.581,35.218,-43.540,35.090,-54.469,18.302,-54.327,18.198,-65.545,21.221,-65.617,21.225,-72.260,16.282,-72.256,16.248,-89.297,35.143,-89.374,35.340,-104.360,3.664,-104.349,3.690,-43.758,14.197,-43.638,14.161,-35.455,3.85,-35.482];
2;
-1;
-2;
# ----------------------------------------
takeEveryNthItem = List.TakeEveryNthItem(list=code_block.out0, n=code_block.out1, offset=code_block.out2)
takeEveryNthItem_2 = List.TakeEveryNthItem(list=code_block.out0, n=code_block.out1, offset=code_block.out3)
byCoordinates = Point.ByCoordinates(x=takeEveryNthItem, y=takeEveryNthItem_2)
code_block_2 = CodeBlock(boundaryPoints=byCoordinates) { boundaryPoints; }
code_block_3 = CodeBlock { 1; }
dropItems = List.DropItems(list=code_block_2, amount=code_block_3)
firstItem = List.FirstItem(list=code_block_2)
join = List.Join(list0=dropItems, list1=firstItem)
byStartPointEndPoint = Line.ByStartPointEndPoint(startPoint=byCoordinates, endPoint=join)
code_block_4 = CodeBlock { [0,1,2,3,4,5,14,15,16,17,18,19]; }
getItemAtIndex = List.GetItemAtIndex(list=byStartPointEndPoint, index=code_block_4)
code_block_5 = CodeBlock { 7; }
extrude = Curve.Extrude(curve=getItemAtIndex, distance=code_block_5)
code_block_6 = CodeBlock(windowsAsSurfaces=extrude) { windowsAsSurfaces; }
code_block_7 = CodeBlock(boundaryAsLines=byStartPointEndPoint) { boundaryAsLines; }
code_block_8 = CodeBlock { 2; }
code_block_9 = CodeBlock(curve=getItemAtIndex, segLength=code_block_8) { segments = Math.Max(2, Math.Floor((Autodesk.Curve.Length(curve)) / segLength)); seq = (0..1..#segments); }
pointAtParameter = Curve.PointAtParameter(curve=getItemAtIndex, param=code_block_9.seq)
code_block_10 = CodeBlock(windowPoints=pointAtParameter) { windowPoints; }
byJoinedCurves = PolyCurve.ByJoinedCurves(curves=byStartPointEndPoint)
byPatch = Surface.ByPatch(closedCurve=byJoinedCurves)
code_block_11 = CodeBlock(boundaryAsSuface=byPatch) { boundaryAsSuface; }
code_block_12 = CodeBlock(windowsAsLines=getItemAtIndex) { windowsAsLines; }

# group: Create GD Regions
code_block_13 = CodeBlock(boundaryPoints=code_block_2) { boundaryPoints; }
code_block_14 = CodeBlock { [0,1,2,19]; [14,15,16]; }
getItemAtIndex_2 = List.GetItemAtIndex(list=code_block_13, index=code_block_14.out0)
byPoints = Polygon.ByPoints(points=getItemAtIndex_2)
getItemAtIndex_3 = List.GetItemAtIndex(list=code_block_13, index=code_block_14.out1)
number_slider = DoubleSlider(14.082, range=0..100 step 0.1)
number_slider_2 = DoubleSlider(-43.638, range=-44.284..100 step 0.1)
byCoordinates_2 = Point.ByCoordinates(x=number_slider, y=number_slider_2)
number_slider_3 = DoubleSlider(14.014, range=0..100 step 0.1)
number_slider_4 = DoubleSlider(-91.124, range=-92.616..100 step 0.1)
byCoordinates_3 = Point.ByCoordinates(x=number_slider_3, y=number_slider_4)
number_slider_5 = DoubleSlider(35.159, range=0..100 step 0.1)
number_slider_6 = DoubleSlider(-91.158, range=-91.158..100 step 0.1)
byCoordinates_4 = Point.ByCoordinates(x=number_slider_5, y=number_slider_6)
join_2 = List.Join(list0=getItemAtIndex_3, list1=byCoordinates_2, list2=byCoordinates_3, list3=byCoordinates_4)
byPoints_2 = Polygon.ByPoints(points=join_2)
list_create = List.Create(item0=byPoints, item1=byPoints_2)
code_block_15 = CodeBlock(gdRegions=list_create) { gdRegions; }

# group: Create Region Spines
number_slider_7 = DoubleSlider(3.846, range=0..100 step 0.1)
number_slider_8 = DoubleSlider(-27.226, range=-28.078..100 step 0.1)
byCoordinates_5 = Point.ByCoordinates(x=number_slider_7, y=number_slider_8)
number_slider_9 = DoubleSlider(35.106, range=0..100 step 0.1)
number_slider_10 = DoubleSlider(-27.226, range=-28.078..100 step 0.1)
byCoordinates_6 = Point.ByCoordinates(x=number_slider_9, y=number_slider_10)
byStartPointEndPoint_2 = Line.ByStartPointEndPoint(startPoint=byCoordinates_5, endPoint=byCoordinates_6)
number_slider_11 = DoubleSlider(8.989, range=0..100 step 0.1)
number_slider_12 = DoubleSlider(-43.64, range=-43.833..100 step 0.1)
byCoordinates_7 = Point.ByCoordinates(x=number_slider_11, y=number_slider_12)
number_slider_13 = DoubleSlider(8.757, range=0..100 step 0.1)
number_slider_14 = DoubleSlider(-98.015, range=-98.104..100 step 0.1)
byCoordinates_8 = Point.ByCoordinates(x=number_slider_13, y=number_slider_14)
number_slider_15 = DoubleSlider(35.171, range=0..100 step 0.1)
number_slider_16 = DoubleSlider(-97.874, range=-97.874..100 step 0.1)
byCoordinates_9 = Point.ByCoordinates(x=number_slider_15, y=number_slider_16)
list_create_2 = List.Create(item0=byCoordinates_7, item1=byCoordinates_8, item2=byCoordinates_9)
byPoints_3 = PolyCurve.ByPoints(points=list_create_2)
list_create_3 = List.Create(item0=byStartPointEndPoint_2, item1=byPoints_3)
code_block_16 = CodeBlock(spineCurves=list_create_3) { spineCurves; }

# group: Inputs
nbr1_spine = DoubleSlider(0.1697643622, range=-0.5..0.5 step 0.1)  # graph input
nbr2_spine = DoubleSlider(0.4715043442, range=-0.5..0.5 step 0.1)  # graph input
list_create_4 = List.Create(item0=nbr1_spine, item1=nbr2_spine)
nbr3_spine = DoubleSlider(-0.4502333711, range=-0.5..0.5 step 0.1)  # graph input
nbr4_spine = DoubleSlider(0.398720335, range=-0.5..0.5 step 0.1)  # graph input
nbr5_spine = DoubleSlider(-0.2584734703, range=-0.5..0.5 step 0.1)  # graph input
nbr6_spine = DoubleSlider(-0.0185359855, range=-0.5..0.5 step 0.1)  # graph input
nbr7_spine = DoubleSlider(0.05876658134, range=-0.5..0.5 step 0.1)  # graph input
nbr8_spine = DoubleSlider(-0.3613664531, range=-0.5..0.5 step 0.1)  # graph input
list_create_5 = List.Create(item0=nbr3_spine, item1=nbr4_spine, item2=nbr5_spine, item3=nbr6_spine, item4=nbr7_spine, item5=nbr8_spine)
list_create_6 = List.Create(item0=list_create_4, item1=list_create_5)
nbr1_perp_spine = DoubleSlider(0.002158906625, range=-0.5..0.5 step 0.1)  # graph input
nbr2_perp_spine = DoubleSlider(-0.4396911781, range=-0.5..0.5 step 0.1)  # graph input
list_create_7 = List.Create(item0=nbr1_perp_spine, item1=nbr2_perp_spine)
nbr3_perp_spine = DoubleSlider(-0.3003929589, range=-0.5..0.5 step 0.1)  # graph input
nbr4_perp_spine = DoubleSlider(0.418573536, range=-0.5..0.5 step 0.1)  # graph input
nbr5_perp_spine = DoubleSlider(0.3220485882, range=-0.5..0.5 step 0.1)  # graph input
nbr6_perp_spine = DoubleSlider(0.02288490785, range=-0.5..0.5 step 0.1)  # graph input
nbr7_perp_spine = DoubleSlider(0.1818457211, range=-0.5..0.5 step 0.1)  # graph input
nbr8_perp_spine = DoubleSlider(0.3755031469, range=-0.5..0.5 step 0.1)  # graph input
list_create_8 = List.Create(item0=nbr3_perp_spine, item1=nbr4_perp_spine, item2=nbr5_perp_spine, item3=nbr6_perp_spine, item4=nbr7_perp_spine, item5=nbr8_perp_spine)
list_create_9 = List.Create(item0=list_create_7, item1=list_create_8)
nbr1_am_side = DoubleSlider(0.09192292643, range=0..1 step 0.1)  # graph input
nbr2_am_side = DoubleSlider(0.6493614574, range=0..1 step 0.1)  # graph input
nbr3_am_side = DoubleSlider(0.1399662001, range=0..1 step 0.1)  # graph input
nbr4_am_side = DoubleSlider(0.4921029136, range=0..1 step 0.1)  # graph input
nbr5_am_side = DoubleSlider(0.1317635219, range=0..1 step 0.1)  # graph input
nbr6_am_side = DoubleSlider(0.1165204886, range=0..1 step 0.1)  # graph input
nbr7_am_side = DoubleSlider(0.1082354521, range=0..1 step 0.1)  # graph input
nbr8_am_side = DoubleSlider(0.2117858812, range=0..1 step 0.1)  # graph input
list_create_10 = List.Create(item0=nbr1_am_side, item1=nbr2_am_side, item2=nbr3_am_side, item3=nbr4_am_side, item4=nbr5_am_side, item5=nbr6_am_side, item6=nbr7_am_side, item7=nbr8_am_side)

# group: Find Neighborhood Center Points
code_block_17 = CodeBlock(spineCurves=code_block_16) { spineCurves; }
code_block_18 = CodeBlock { neighborhoodSizes = [2,6]; }
code_block_19 = CodeBlock(parameterAdjustAlongSpine=list_create_6) { parameterAdjustAlongSpine; }
code_block_20 = CodeBlock(n=code_block_18, adjust=code_block_19) { initial = ((1/(n*2))..(1-(1/(n*2)))..#n); i = initial + (adjust  * (1/(n*2))); }
pointAtParameter_2 = Curve.PointAtParameter(curve=code_block_17, param=code_block_20.i)
normalAtParameter = Curve.NormalAtParameter(curve=code_block_17, param=code_block_20.i)
code_block_21 = CodeBlock(parameterAdjustPerpindicularToSpine=list_create_9) { parameterAdjustPerpindicularToSpine; }
code_block_22 = CodeBlock { regionThickness = [6,6]; }
code_block_23 = CodeBlock(d=code_block_21, thickness=code_block_22) { d*thickness; }
translate = Geometry.Translate(geometry=pointAtParameter_2, direction=normalAtParameter, distance=code_block_23)
code_block_24 = CodeBlock(neighboroodCenterPoints=translate) { neighboroodCenterPoints; }

# group: Create Neighborhood Regions
code_block_25 = CodeBlock(gdRegions=code_block_15) { gdRegions; }
byPatch_2 = Surface.ByPatch(closedCurve=code_block_25)
boundingBox = Geometry.BoundingBox(geometry=code_block_25)
code_block_26 = CodeBlock(bb=boundingBox)
# ---------- code_block_26.designscript (5 lines) ----------
p1 = bb.MinPoint;
p2 = bb.MaxPoint;
p3 = Point.ByCoordinates(p1.X, p2.Y);
p4 = Point.ByCoordinates(p2.X, p1.Y);
Rectangle.ByCornerPoints(p1, p3, p2, p4);
# ----------------------------------------
byPatch_3 = Surface.ByPatch(closedCurve=code_block_26.out4)
code_block_27 = CodeBlock(neighboroodCenterPoints=code_block_24) { neighboroodCenterPoints; }
code_block_28 = CodeBlock { 15; }
offset = Curve.Offset(curve=code_block_26.out4, distance=code_block_28)
explode = Geometry.Explode(geometry=offset)
startPoint = Curve.StartPoint(curve=explode)
code_block_29 = CodeBlock(a=code_block_27, b=startPoint)
# ---------- code_block_29.designscript (2 lines) ----------
[List.Flatten([a[0], b[0]], -1),
List.Flatten([a[1], b[1]], -1)];
# ----------------------------------------
UVParameterAtPoint = Surface.UVParameterAtPoint(surface=byPatch_3, point=code_block_29)
byParametersOnSurface = Tessellation.Voronoi.ByParametersOnSurface(uvs=UVParameterAtPoint, face=byPatch_3)
intersect = Geometry.Intersect(geometry=byPatch_2, other=byParametersOnSurface)
flatten = List.Flatten(list=intersect@L3)
extrude_2 = Curve.Extrude(curve=flatten)
byJoinedSurfaces = PolySurface.ByJoinedSurfaces(surfaces=extrude_2)
split = Geometry.Split(geometry=byPatch_2, other=byJoinedSurfaces)
code_block_30 = CodeBlock(a=split) { neighborhoodSurfaces = List.Flatten(a); }

code_block_31 = CodeBlock(amenityEdgeParams=list_create_10) { amenityEdgeParams; }

# group: Split Neighborhood into Amenity and Desk Areas
code_block_32 = CodeBlock(neighborhoodSurfaces=code_block_30) { neighborhoodSurfaces; }
code_block_33 = CodeBlock(neighborhoodSurfaces=code_block_32) { neighborhoodSurfaces; }
perimeterCurves = Surface.PerimeterCurves(surface=code_block_32)
length = Curve.Length(curve=perimeterCurves)
code_block_34 = CodeBlock { minEdgeLen = 12; }
gt = length > code_block_34
filterByBoolMask = List.FilterByBoolMask(list=perimeterCurves, mask=gt)
count = List.Count(list=filterByBoolMask.in@L2)
code_block_35 = CodeBlock(amenityEdgeParams=code_block_31) { amenityEdgeParams; }
code_block_36 = CodeBlock(c=count, params=code_block_35) { Math.Round((c-1) * params); }
getItemAtIndex_4 = List.GetItemAtIndex(list=filterByBoolMask.in@L2, index=code_block_36, lacing=Shortest)
code_block_37 = CodeBlock(pickedEdges=getItemAtIndex_4) { pickedEdges; }
code_block_38 = CodeBlock(t=code_block_37) { midpoint = Curve.PointAtParameter(t, 0.5); tan1 = Curve.NormalAtParameter(t, 0.5); tan2 = Vector.Reverse(tan1); }
list_create_11 = List.Create(item0=code_block_38.tan1, item1=code_block_38.tan2)
transpose = List.Transpose(lists=list_create_11)
normalized = Vector.Normalized(vector=transpose)
code_block_39 = CodeBlock { width = 5; }
translate_2 = Geometry.Translate(geometry=code_block_37, direction=normalized, distance=code_block_39)
doesIntersect = Geometry.DoesIntersect(geometry=code_block_33, other=translate_2)
filterByBoolMask_2 = List.FilterByBoolMask(list=translate_2, mask=doesIntersect)
flatten_2 = List.Flatten(list=filterByBoolMask_2.in)
code_block_40 = CodeBlock { 0.5; }
pointAtParameter_3 = Curve.PointAtParameter(curve=flatten_2, param=code_block_40)
byOriginNormal = Plane.ByOriginNormal(origin=pointAtParameter_3)
code_block_41 = CodeBlock { 4; }
scale = Geometry.Scale(geometry=flatten_2, plane=byOriginNormal, xamount=code_block_41, yamount=code_block_41)
split_2 = Geometry.Split(geometry=code_block_33, other=scale)
code_block_42 = CodeBlock(pickedEdges=code_block_37) { pickedEdges; }
doesIntersect_2 = Geometry.DoesIntersect(geometry=code_block_42, other=split_2)
filterByBoolMask_3 = List.FilterByBoolMask(list=split_2, mask=doesIntersect_2)
flatten_3 = List.Flatten(list=filterByBoolMask_3.in)
intersect_2 = Geometry.Intersect(geometry=flatten_3, other=scale)
isEmpty = List.IsEmpty(list=intersect_2@L2)
filterByBoolMask_4 = List.FilterByBoolMask(list=flatten_3, mask=isEmpty)
code_block_43 = CodeBlock(amenityAreas=filterByBoolMask_4.out) { amenityAreas; }
flatten_4 = List.Flatten(list=intersect_2)
code_block_44 = CodeBlock(splitEdge=flatten_4) { splitEdge; }
flatten_5 = List.Flatten(list=filterByBoolMask_3.out)
code_block_45 = CodeBlock(deskAreas=flatten_5) { deskAreas; }

# group: Create Simple Amenity Spaces
code_block_46 = CodeBlock(amenityAreas=code_block_43) { amenityAreas; }
perimeterCurves_2 = Surface.PerimeterCurves(surface=code_block_46)
byJoinedCurves_2 = PolyCurve.ByJoinedCurves(curves=perimeterCurves_2)
code_block_47 = CodeBlock { -1.2; }
offset_2 = Curve.Offset(curve=byJoinedCurves_2, distance=code_block_47)
code_block_48 = CodeBlock(amenityCurves=offset_2) { amenityCurves; }
explode_2 = Geometry.Explode(geometry=code_block_48)
code_block_49 = CodeBlock(splitEdge=code_block_44) { splitEdge; }
pickEdgeClosestToLine = Python(IN[0]=explode_2, IN[1]=code_block_49)
# ---------- pickEdgeClosestToLine.python (23 lines) ----------
# Load the Python Standard and DesignScript Libraries
import sys
import clr
clr.AddReference('ProtoGeometry')
from Autodesk.DesignScript.Geometry import *

# The inputs to this node will be stored as a list in the IN variables.
edges = IN[0]
guideEdge = IN[1]

pickedEdges = []
otherEdges = []

for idx, eList in enumerate(edges):
	otherEdges.append([])
	cp = map(lambda x: Curve.PointAtParameter(x, 0.5), eList)
	edgeL = zip(eList, cp)
	edgeL.sort(key = lambda x: Geometry.DistanceTo( Curve.PointAtParameter(guideEdge[idx], 0.5), x[1]))
	pickedEdges.append(edgeL[0][0])
	for k in range(1, len(edgeL)):
		otherEdges[idx].append(edgeL[k][0])
# Assign your output to the OUT variable.
OUT = [pickedEdges, otherEdges]
# ----------------------------------------
code_block_50 = CodeBlock(a=pickEdgeClosestToLine) { a[0]; a[1]; }
code_block_51 = CodeBlock(edgeWithDoor=code_block_50.out0) { edgeWithDoor; }
code_block_52 = CodeBlock { [0.4, 0.6]; }
splitByParameter = Curve.SplitByParameter(curve=code_block_51, parameters=code_block_52)
code_block_53 = CodeBlock { 1; }
removeItemAtIndex = List.RemoveItemAtIndex(list=splitByParameter@L2, indices=code_block_53)
code_block_54 = CodeBlock(otherEdges=code_block_50.out1) { otherEdges; }
list_create_12 = List.Create(item0=removeItemAtIndex, item1=code_block_54)
transpose_2 = List.Transpose(lists=list_create_12)
code_block_55 = CodeBlock(roomWalls=transpose_2) { roomWalls; }
byPatch_4 = Surface.ByPatch(closedCurve=offset_2)
code_block_56 = CodeBlock { 0.5; }
pointAtParameter_4 = Surface.PointAtParameter(surface=byPatch_4, u=code_block_56, v=code_block_56)
code_block_57 = CodeBlock(roomCenter=pointAtParameter_4) { roomCenter; }
code_block_58 = CodeBlock(amenitySpaces=byPatch_4) { amenitySpaces; }
code_block_59 = CodeBlock(amenityCurves=code_block_48) { amenityCurves; }

# group: Display Amenity Areas
code_block_60 = CodeBlock { 2; }
extrude_3 = Curve.Extrude(curve=code_block_55, distance=code_block_60)
color_palette = ColorPalette({R: 100, G: 149, B: 237, A: 196})
byGeometryColor = Modifiers.GeometryColor.ByGeometryColor(geometry=extrude_3, color=color_palette)
code_block_61 = CodeBlock(amenityCurves=code_block_59) { amenityCurves; }
color_palette_2 = ColorPalette({R: 0, G: 191, B: 255, A: 255})
byGeometryColor_2 = Modifiers.GeometryColor.ByGeometryColor(geometry=code_block_58, color=color_palette_2)

# group: Display Neighborhood Spines
color_palette_3 = ColorPalette({R: 255, G: 127, B: 80, A: 255})
byGeometryColor_3 = Modifiers.GeometryColor.ByGeometryColor(geometry=code_block_16, color=color_palette_3)

# group: Display Boundary & Windows
color_palette_4 = ColorPalette({R: 0, G: 191, B: 255, A: 71})
byGeometryColor_4 = Modifiers.GeometryColor.ByGeometryColor(geometry=code_block_6, color=color_palette_4)
color_palette_5 = ColorPalette({R: 0, G: 0, B: 0, A: 255})
byGeometryColor_5 = Modifiers.GeometryColor.ByGeometryColor(geometry=code_block_7, color=color_palette_5)

code_block_62 = CodeBlock(boundaryAsLines=code_block_7) { boundaryAsLines; }

# group: Create Column System
code_block_63 = CodeBlock()
# ---------- code_block_63.designscript (4 lines) ----------
[6.236,-19.383,15.636,-19.383,25.036,-19.383,34.436,-19.383,6.236,-25.619,15.636,-25.619,25.036,-25.619,34.436,-25.619,6.236,-34.818,15.636,-34.818,25.036,-34.818,34.436,-34.818,6.236,-44.608,15.636,-44.608,25.036,-44.608,34.436,-44.608,6.236,-54.16,6.236,-63.66,6.236,-73.16,6.236,-82.66,6.236,-92.16,6.236,-101.66,15.695,-54.16,15.695,-63.66,15.695,-73.16,15.695,-82.66,15.695,-92.16,15.695,-101.66,34.62,-92.082,34.62,-101.582,25.12,-92.082,25.12,-101.582];
2;
-1;
-2;
# ----------------------------------------
takeEveryNthItem_3 = List.TakeEveryNthItem(list=code_block_63.out0, n=code_block_63.out1, offset=code_block_63.out2)
takeEveryNthItem_4 = List.TakeEveryNthItem(list=code_block_63.out0, n=code_block_63.out1, offset=code_block_63.out3)
byCoordinates_10 = Point.ByCoordinates(x=takeEveryNthItem_3, y=takeEveryNthItem_4)
byOrigin = CoordinateSystem.ByOrigin(origin=byCoordinates_10)
byWidthLength = Rectangle.ByWidthLength(cs=byOrigin)
code_block_64 = CodeBlock(columnsAsRect=byWidthLength) { columnsAsRect; }
explode_3 = Geometry.Explode(geometry=byWidthLength)
code_block_65 = CodeBlock { 1; }
approximateCurvesWithLines = Custom[Utils.ApproximateCurvesWithLines](curves=explode_3, segmentLength=code_block_65)  # Approximate Curves With Lines
code_block_66 = CodeBlock(columnsAsLines=approximateCurvesWithLines) { columnsAsLines; }

code_block_67 = CodeBlock(columnsAsRect=code_block_64) { columnsAsRect; }

# group: Create Desks
code_block_68 = CodeBlock(deskAreas=code_block_45) { deskAreas; }
perimeterCurves_3 = Surface.PerimeterCurves(surface=code_block_68)
byJoinedCurves_3 = PolyCurve.ByJoinedCurves(curves=perimeterCurves_3)
code_block_69 = CodeBlock { -0.5; }
offset_3 = Curve.Offset(curve=byJoinedCurves_3, distance=code_block_69)
byPatch_5 = Surface.ByPatch(closedCurve=offset_3)
code_block_70 = CodeBlock(shrankedArea=byPatch_5) { shrankedArea; }
code_block_71 = CodeBlock(columns=code_block_67) { columns; }
count_2 = List.Count(list=code_block_70)
ofRepeatedItem = List.OfRepeatedItem(item=code_block_71, amount=count_2)
doesIntersect_3 = Geometry.DoesIntersect(geometry=code_block_70, other=code_block_71, lacing=CrossProduct)
filterByBoolMask_5 = List.FilterByBoolMask(list=ofRepeatedItem, mask=doesIntersect_3)
code_block_72 = CodeBlock(columns=filterByBoolMask_5.in) { columns; }
code_block_73 = CodeBlock { deskWidth = 0.8; deskLenth = 1.8; rowOffset = 2; }
python_script = Python(IN[0]=code_block_70, IN[1]=code_block_72, IN[2]=code_block_73.deskWidth, IN[3]=code_block_73.deskLenth, IN[4]=code_block_73.rowOffset)
# ---------- python_script.python (141 lines) ----------
# Enable Python support and load DesignScript library
import math
import clr

clr.AddReference('ProtoGeometry')
from Autodesk.DesignScript.Geometry import *

def countDeskFunc(k):
    return len(k)

def lenCurveFunc(k):
    return k.Length

def filterEdges(e):
	return e.Length > 1

def scaleLine(line, scale):
	midPoint = line.PointAtParameter(0.5)
	plane = Plane.ByOriginNormal(midPoint, Vector.ByCoordinates(0,0,1))
	ret = Geometry.Scale(line, plane, scale, scale, 1)
	midPoint.Dispose()
	plane.Dispose()
	return ret

def placeRowOfDesks(s, edges, offsetEdge, offsetDir, desks, deskPoints, deskDirections, deskWidth, deskLength, rowOffset, columns):
	dCount = 0
	deskCount = offsetEdge.Length / deskLength
	if deskCount >= 2:
		deskPlacements = Curve.PointsAtEqualSegmentLength(offsetEdge, deskCount) #PointsAtEqualSegmentLength PointsAtEqualChordLength
		perpDir = offsetEdge.TangentAtParameter(0.5)
		for deskP in deskPlacements:
			vec1 = offsetDir.Scale(deskWidth * 0.5)
			vec2 = vec1.Reverse()
			vec3 = offsetDir.Scale(deskWidth * 1.5)
			vec4 = vec3.Reverse()
			r1 = Point.Add(deskP, vec1)
			r2 = Point.Add(deskP, vec2)
			r3 = Point.Add(deskP, vec3)
			r4 = Point.Add(deskP, vec4)
			desk = Rectangle.ByWidthLength(CoordinateSystem.ByOriginVectors(r1, offsetDir, perpDir), deskWidth, deskLength)
			desk2 = Rectangle.ByWidthLength(CoordinateSystem.ByOriginVectors(r2, offsetDir, perpDir), deskWidth, deskLength)
			intersects1 = False
			intersects2 = False
			for col in columns:
				if Geometry.DoesIntersect(col, desk):
					intersects1 = True
				if Geometry.DoesIntersect(col, desk2):
					intersects2 = True
			for e in edges:
				if Geometry.DoesIntersect(e, desk):
					intersects1 = True
				if Geometry.DoesIntersect(e, desk2):
					intersects2 = True	
			
			if not intersects1 and Geometry.DoesIntersect(s, desk):
				desks.append(desk)
				dCount += 1
				deskPoints.append(r3)
				deskDirections.append(Vector.ByTwoPoints(r3, r1))
			else:
				desk.Dispose()
				r3.Dispose()
			
			if not intersects2 and Geometry.DoesIntersect(s, desk2):
				desks.append(desk2)
				dCount += 1
				deskPoints.append(r4)
				deskDirections.append(Vector.ByTwoPoints(r4, r2))
			else:
				desk2.Dispose()
				r4.Dispose()
		
			vec1.Dispose()
			vec2.Dispose()
			r1.Dispose()
			r2.Dispose()
		perpDir.Dispose()
	return dCount
	
# The inputs to this node will be stored as a list in the IN variables.
surfaces = IN[0]
allColumns = IN[1]
deskWidth = IN[2]
deskLength = IN[3]
rowOffset = IN[4]

desks = []
deskPoints = []
deskDirections = []
deskCounts = []
if surfaces and allColumns:
	for i in range(len(surfaces)):
		surface = surfaces[i]
		# figure out direction
		deskCount = 0
		desksGroup = []
		deskPointsGroup = []
		deskDirectionsGroup = []
		edges = surface.PerimeterCurves()
		filteredEdges = filter(filterEdges, edges)
		edge = max(filteredEdges, key=lenCurveFunc)
		centerPt = surface.PointAtParameter(0.5, 0.5)
		midpoint = edge.PointAtParameter(0.5)
		offsetDir0 = Vector.ByTwoPoints(midpoint, centerPt);
		offsetDir1 = edge.NormalAtParameter(0.5)
		offsetDir2 = Vector.Reverse(offsetDir1)
		offsetDir = offsetDir1
		if Vector.AngleWithVector(offsetDir0, offsetDir1) > 90:
			offsetDir = offsetDir2
		
		j = 0
		while True:
			offset =  str(j) + ": " + str((rowOffset + deskWidth) + ((rowOffset + (deskWidth*2)) * j))
			offsetEdge = Geometry.Translate(edge, offsetDir, (rowOffset + deskWidth) + ((rowOffset + (deskWidth*2)) * j))
			offsetEdge2 = scaleLine(offsetEdge, 20)
			offsetEdge3 = Geometry.Intersect(surface, offsetEdge2)
			if offsetEdge3:
				dCount = placeRowOfDesks(surface, edges, offsetEdge3[0], offsetDir, desksGroup, deskPointsGroup, deskDirectionsGroup, deskWidth, deskLength, rowOffset, allColumns[i])
				deskCount += dCount
			offsetEdge.Dispose()
			offsetEdge2.Dispose()
			for e in offsetEdge3:
				e.Dispose()
			
			if not offsetEdge3:
				break
			j += 1
		centerPt.Dispose()
		midpoint.Dispose()
		offsetDir.Dispose()
		offsetDir0.Dispose()
		offsetDir1.Dispose()
		offsetDir2.Dispose()
		#pc.Dispose()
		deskCounts.append(deskCount)
		desks.append(desksGroup)
		deskPoints.append(deskPointsGroup)
		deskDirections.append(deskDirectionsGroup)

# Assign your output to the OUT variable.
OUT = [desks, deskPoints, deskDirections, deskCounts]
# ----------------------------------------
code_block_74 = CodeBlock(a=python_script) { a[0]; a[1]; a[2]; a[3]; }
code_block_75 = CodeBlock(deskRects=code_block_74.out0) { deskRects; }
code_block_76 = CodeBlock(deskPts=code_block_74.out1) { deskPts; }
code_block_77 = CodeBlock(deskDirection=code_block_74.out2) { deskDirection; }
code_block_78 = CodeBlock(deskCounts=code_block_74.out3) { deskCounts; }

code_block_79 = CodeBlock(deskRects=code_block_75) { deskRects; }

# group: Landmarks
code_block_80 = CodeBlock { [20.342,-69.039,20.758,-53.683,27.862,-53.051,20.342,-69.039]; 2; -1; -2; }
takeEveryNthItem_5 = List.TakeEveryNthItem(list=code_block_80.out0, n=code_block_80.out1, offset=code_block_80.out2)
takeEveryNthItem_6 = List.TakeEveryNthItem(list=code_block_80.out0, n=code_block_80.out1, offset=code_block_80.out3)
byCoordinates_11 = Point.ByCoordinates(x=takeEveryNthItem_5, y=takeEveryNthItem_6)
code_block_81 = CodeBlock(landmarks=byCoordinates_11) { landmarks; }

code_block_82 = CodeBlock(landmarks=code_block_81) { landmarks; }
parallelize_metrics = BoolSelector(true)
code_block_83 = CodeBlock(columnsAsLines=code_block_66) { columnsAsLines; }

# group: Create Path Lattice
code_block_84 = CodeBlock(boundaryAsLines=code_block_62) { boundaryAsLines; }
code_block_85 = CodeBlock(deskRects=code_block_79) { deskRects; }
approximateCurvesWithLines_2 = Custom[Utils.ApproximateCurvesWithLines](curves=code_block_85)
code_block_86 = CodeBlock(roomWalls=code_block_55) { roomWalls; }
approximateCurvesWithLines_3 = Custom[Utils.ApproximateCurvesWithLines](curves=code_block_86)
join_3 = List.Join(list0=code_block_84, list1=approximateCurvesWithLines_2, list2=approximateCurvesWithLines_3)
byGeometry = BoundingBox.ByGeometry(geom=join_3)
code_block_87 = CodeBlock { 0.4; }
byBoundingBoxAndLines = Core.SpaceLattice.ByBoundingBoxAndLines(boundingBox=byGeometry, barriers=join_3, resolution=code_block_87)
code_block_88 = CodeBlock(pathLattice=byBoundingBoxAndLines) { pathLattice; }
code_block_89 = CodeBlock(columnsAsLines=code_block_83) { columnsAsLines; }

# group: Find Shortest Paths
code_block_90 = CodeBlock(pathLattice=code_block_88) { pathLattice; }
code_block_91 = CodeBlock(landmarks=code_block_82) { landmarks; }
code_block_92 = CodeBlock(roomCenter=code_block_57) { roomCenter; }
join_4 = List.Join(list0=code_block_91, list1=code_block_92)
closestPointTo = Core.SpaceLattice.ClosestPointTo(spaceLattice=code_block_90, point=join_4)
bySpaceLatticeAndEndPoint = Pathfinding.PathField.BySpaceLatticeAndEndPoint(spaceLattice=code_block_90, endPoint=closestPointTo)
code_block_93 = CodeBlock(deskPositions=code_block_76) { deskPositions; }
closestPointTo_2 = Core.SpaceLattice.ClosestPointTo(spaceLattice=code_block_90, point=code_block_93)
byPathField = Pathfinding.Route.ByPathField(pathField=bySpaceLatticeAndEndPoint, otherPoint=closestPointTo_2, lacing=CrossProduct)
flatten_6 = List.Flatten(list=byPathField)
count_3 = Pathfinding.Route.Count(route=flatten_6)
code_block_94 = CodeBlock { 0; }
gt_2 = count_3 > code_block_94
filterByBoolMask_6 = List.FilterByBoolMask(list=flatten_6, mask=gt_2)
code_block_95 = CodeBlock(routes=filterByBoolMask_6.in) { routes; }
python_script_2 = Python(IN[0]=count_3)
# ---------- python_script_2.python (19 lines) ----------
# Panalizing desks that are innessesible
import sys
import clr
clr.AddReference('ProtoGeometry')
from Autodesk.DesignScript.Geometry import *

# The inputs to this node will be stored as a list in the IN variables.
counts = IN[0]
outC = []
maxVal  = max(counts)
# Place your code below this line
for c in counts:
	if c == 0:
		outC.append(maxVal)
	else:
		outC.append(c)	
		
# Assign your output to the OUT variable.
OUT = outC
# ----------------------------------------
code_block_96 = CodeBlock(pathApproximateLengths=python_script_2) { pathApproximateLengths; }
code_block_97 = CodeBlock { false; }
clean = List.Clean(list=flatten_6, preserveIndices=code_block_97)

# group: Display Path Curves
code_block_98 = CodeBlock { 3; }
curve = Pathfinding.Route.Curve(route=code_block_95, tidyIterations=code_block_98)

code_block_99 = CodeBlock(pathLattice=code_block_88) { pathLattice; }

# group: Buzz Metric
code_block_100 = CodeBlock(pathLattice=code_block_99) { pathLattice; }
code_block_101 = CodeBlock(routes=code_block_95) { routes; }
flatten_7 = List.Flatten(list=code_block_101)
code_block_102 = CodeBlock(parallelize=parallelize_metrics) { parallelize; }
parallel_congestion_values = Python(IN[0]=code_block_100, IN[1]=flatten_7, IN[2]=code_block_102)
# ---------- parallel_congestion_values.python (103 lines) ----------
import clr
import math
clr.AddReference('ProtoGeometry')
from Autodesk.DesignScript.Geometry import *
clr.AddReference('DSCoreNodes')
from DSCore import Math
from System.Threading.Tasks import *
from System.Threading import Monitor

pathLattice = IN[0]
paths = IN[1]
parallel = IN[2]

xCoordinates = pathLattice.XCoordinates()
yCoordinates = pathLattice.YCoordinates()
xCoordinatesLen = len(xCoordinates)
yCoordinatesLen = len(yCoordinates)

rangeMinX = xCoordinates[0]
rangeMaxX = xCoordinates[xCoordinatesLen-1]
rangeMinY = yCoordinates[0]
rangeMaxY = yCoordinates[yCoordinatesLen-1]

r = []

box_kernel = [[1 / 9.0, 1 / 9.0, 1 / 9.0],
              [1 / 9.0, 1 / 9.0, 1 / 9.0],
              [1 / 9.0, 1 / 9.0, 1 / 9.0]]

rhys_kernel = [[1 / 16.0, 1 / 8.0, 1 / 16.0],
              [1 / 8.0, 1 / 4.0, 1 / 8.0],
              [1 / 16.0, 1 / 8.0, 1 / 16.0]]
kernel = rhys_kernel          
              
values = [[0 for i in range(yCoordinatesLen)] for j in range(xCoordinatesLen)]
maxLen = 0;

def initPath(path, values, pathLattice, maxLen):

    if maxLen < path.Count():
        maxLen = path.Count()
    for i in range(path.Count()):
        x_coord = int(math.floor(Math.MapTo(rangeMinX, rangeMaxX, path.XPositionAtIndex(i), 0, xCoordinatesLen-1)))
        y_coord = int(math.floor(Math.MapTo(rangeMinY, rangeMaxY, path.YPositionAtIndex(i), 0, yCoordinatesLen-1)))
        Monitor.Enter(values)
        values[x_coord][y_coord] += 1.0
        Monitor.Exit(values)

if parallel:
	Parallel.ForEach(paths, lambda path: initPath(path, values, pathLattice, maxLen))
else:
	for path in paths:
		initPath(path, values, pathLattice, maxLen)

# Dissipating
iterations = 3
for i in range(iterations):
	for y in range(1, yCoordinatesLen - 1):
	    for x in range(1, xCoordinatesLen - 1):		
	        acc = 0
	        for a in range(-1, 2):
	            for b in range(-1, 2):
	                xn = x + a
	                yn = y + b
	                v =  values[xn][yn]
	                acc += v * kernel[a + 1][b + 1]
			values[x][y] = acc


# Route Congestion & Calc Buzz
top = [0 for i in range(len(paths))] 
bottom = [0 for i in range(len(paths))] 

def calculateScore(path, index, top, bottom, pathLattice):

    cong = []
    for i in range(path.Count()):
        x_coord = int(math.floor(Math.MapTo(rangeMinX, rangeMaxX, path.XPositionAtIndex(i), 0, xCoordinatesLen-1)))
        y_coord = int(math.floor(Math.MapTo(rangeMinY, rangeMaxY, path.YPositionAtIndex(i), 0, yCoordinatesLen-1 )))
        cong.append(values[x_coord][y_coord])
    
    if len(cong) > 0:
        h_j = max(cong) - min(cong)
        H_j = 0
        for ji in range(0, len(cong)-1):
            H_j += math.fabs(cong[ji+1] - cong[ji])
        top[index] = path.Count() * H_j
        bottom[index] = path.Count() * h_j

if parallel:
	Parallel.ForEach(paths, lambda path, state, i: calculateScore(path, i, top, bottom, pathLattice))
else:
	for idx, path in enumerate(paths):
		calculateScore(path, idx, top, bottom, pathLattice)

if bottom > 0:
	buzz = (sum(top) / sum(bottom)) - 1
else:
	buzz = 0

congestion = values

OUT = [congestion, buzz] 
# ----------------------------------------
code_block_103 = CodeBlock(a=parallel_congestion_values) { a[0]; a[1]; }
code_block_104 = CodeBlock(congestionMap=code_block_103.out0) { congestionMap; }
buzz_max = Watch(code_block_103.out1)  # graph output
code_block_105 = CodeBlock(buzz=code_block_103.out1) { buzz; }

code_block_106 = CodeBlock(amenitySpaces=code_block_58) { amenitySpaces; }

# group: Create Visibility Lattice
code_block_107 = CodeBlock(boundaryAsLines=code_block_62) { boundaryAsLines; }
code_block_108 = CodeBlock(columnsAsLines=code_block_83) { columnsAsLines; }
code_block_109 = CodeBlock(amenityArea=code_block_106) { amenityArea; }
perimeterCurves_4 = Surface.PerimeterCurves(surface=code_block_109)
code_block_110 = CodeBlock { 1; }
approximateCurvesWithLines_4 = Custom[Utils.ApproximateCurvesWithLines](curves=perimeterCurves_4, segmentLength=code_block_110)
join_5 = List.Join(list0=code_block_107, list1=code_block_108, list2=approximateCurvesWithLines_4)
byGeometry_2 = BoundingBox.ByGeometry(geom=join_5)
code_block_111 = CodeBlock { 1; }
byBoundingBoxAndLines_2 = Core.SpaceLattice.ByBoundingBoxAndLines(boundingBox=byGeometry_2, barriers=join_5, resolution=code_block_111)
code_block_112 = CodeBlock(visibilityLattice=byBoundingBoxAndLines_2) { visibilityLattice; }

code_block_113 = CodeBlock(boundaryAsSuface=code_block_11) { boundaryAsSuface; }
code_block_114 = CodeBlock(boundaryAsSuface=code_block_113) { boundaryAsSuface; }

# group: Create Window Visibility Grid
code_block_115 = CodeBlock(visibilityLattice=code_block_112) { visibilityLattice; }
code_block_116 = CodeBlock(windowSamplePoints=code_block_10) { windowSamplePoints; }
closestPointTo_3 = Core.SpaceLattice.ClosestPointTo(spaceLattice=code_block_115, point=code_block_116)
flatten_8 = List.Flatten(list=closestPointTo_3)
code_block_117 = CodeBlock(boundarySuface=code_block_114) { boundarySuface; }
doesIntersect_4 = Geometry.DoesIntersect(geometry=code_block_117, other=flatten_8)
filterByBoolMask_7 = List.FilterByBoolMask(list=flatten_8, mask=doesIntersect_4)
code_block_118 = CodeBlock(amenitySpaces=code_block_106) { amenitySpaces; }
byJoinedSurfaces_2 = PolySurface.ByJoinedSurfaces(surfaces=code_block_118)
doesIntersect_5 = Geometry.DoesIntersect(geometry=filterByBoolMask_7.in, other=byJoinedSurfaces_2)
filterByBoolMask_8 = List.FilterByBoolMask(list=filterByBoolMask_7.in, mask=doesIntersect_5)
code_block_119 = CodeBlock { distanceThreshold = 40; }
bySpaceLatticeAndViewPoint = Visibility.ViewField.BySpaceLatticeAndViewPoint(spaceLattice=code_block_115, viewPoint=filterByBoolMask_8.out, radius=code_block_119)
byUnion = Visibility.VisibilityGrid.ByUnion(ViewFields=bySpaceLatticeAndViewPoint)
code_block_120 = CodeBlock(visibilityGrid=byUnion) { visibilityGrid; }
code_block_121 = CodeBlock(viewPts=filterByBoolMask_8.out) { viewPts; }

code_block_122 = CodeBlock(visibilityLattice=code_block_112) { visibilityLattice; }
code_block_123 = CodeBlock(deskPts=code_block_76) { deskPts; }
code_block_124 = CodeBlock(deskDirection=code_block_77) { deskDirection; }

# group: Views to Outside Metric
code_block_125 = CodeBlock(visibilityGrid=code_block_120) { visibilityGrid; }
code_block_126 = CodeBlock(routes=code_block_95) { routes; }
points = Pathfinding.Route.Points(route=code_block_126)
flatten_9 = List.Flatten(list=points)
valueAtPoint = Visibility.VisibilityGrid.ValueAtPoint(visibilityGrid=code_block_125, point=flatten_9)
sum = Math.Sum(values=valueAtPoint)
count_4 = List.Count(list=flatten_9)
code_block_127 = CodeBlock(sN=sum, N=count_4) { sN / N; }
code_block_128 = CodeBlock(ViewsToOutsideFromCirculation=code_block_127) { ViewsToOutsideFromCirculation; }
code_block_129 = CodeBlock(visibilityLattice=code_block_122) { visibilityLattice; }
code_block_130 = CodeBlock(desks=code_block_123) { desks; }
flatten_10 = List.Flatten(list=code_block_130)
code_block_131 = CodeBlock(deskOrientations=code_block_124) { deskOrientations; }
flatten_11 = List.Flatten(list=code_block_131)
code_block_132 = CodeBlock { distanceThreshold = 20; }
code_block_133 = CodeBlock(viewPts=code_block_121) { viewPts; }
python_script_3 = Python(IN[0]=code_block_129, IN[1]=flatten_10, IN[2]=flatten_11, IN[3]=code_block_132, IN[4]=code_block_133)
# ---------- python_script_3.python (48 lines) ----------
import sys
import clr

clr.AddReference('ProtoGeometry')
clr.AddReference('SpaceAnalysis')
from Autodesk.DesignScript.Geometry import *
from System.Threading.Tasks import *
from System.Threading.Tasks import *
from Visibility import *

def Average(lst): 
    return sum(lst) / len(lst) 

visibilityLattice = IN[0]
desks = IN[1]
deskOrientations = IN[2]
distanceThreshold = IN[3]
windowPoints = IN[4]

resultsCount = [0 for x in range(len(desks))]
resultsDist = [0 for x in range(len(desks))]
resultsPts = [0 for x in range(len(desks))]

def calculateViewsToOutside(point, pt_o, i, visLattice, distanceThreshold, windowPoints, resultsC, resultsD, resultsPts):
	if len(windowPoints) > 0:
		viewField = ViewField.BySpaceLatticeAndViewPoint(visLattice, point, distanceThreshold)
		visGrid = VisibilityGrid.ByViewField(viewField)
		count = 0
		distances = []
		minD = 9999999
		for window in windowPoints:	
			if(visGrid.ValueAtPoint(window) > 0.1):
				vecToPoint = Vector.ByTwoPoints(point, window)
				angle = pt_o.AngleWithVector(vecToPoint)
				if angle <= 110:
					d = Geometry.DistanceTo(point, window)
					if d < minD:
						resultsPts[i] = window
						minD = d
					count += 1.0
					distances.append(d)
		resultsC[i] = count
		if len(distances) > 0:
			resultsC[i] *= (1 / Average(distances))
			resultsD[i] = min(distances)
		
Parallel.ForEach(desks, lambda point, state, i: calculateViewsToOutside(point, deskOrientations[i], i, visibilityLattice, distanceThreshold, windowPoints, resultsCount, resultsDist, resultsPts))
OUT = [resultsCount, resultsDist, resultsPts]
# ----------------------------------------
code_block_134 = CodeBlock(a=python_script_3) { normDist = a[0]; dists = a[1]; windows = a[2]; }
minimumItem = List.MinimumItem(list=code_block_134.normDist)
maximumItem = List.MaximumItem(list=code_block_134.normDist)
map = Math.Map(rangeMin=minimumItem, rangeMax=maximumItem, inputValue=code_block_134.normDist)
average = Math.Average(numbers=map)
code_block_135 = CodeBlock(ViewsToOutsideFromWorkspaces=average) { ViewsToOutsideFromWorkspaces; }
code_block_136 = CodeBlock(a=code_block_128, b=code_block_135) { (a+b)/2; }
views_to_outside_max = Watch(code_block_136)  # graph output
code_block_137 = CodeBlock(viewsToOutside=code_block_136) { viewsToOutside; }
code_block_138 = CodeBlock(deskPoints=flatten_10) { deskPoints; }
code_block_139 = CodeBlock(windowPts=code_block_134.windows) { windowPts; }
code_block_140 = CodeBlock(rawDists=code_block_134.dists) { rawDists; }
code_block_141 = CodeBlock(viewsToOutsidePerDesk=map) { viewsToOutsidePerDesk; }

# group: Display Neighborhood Central Points
color_palette_6 = ColorPalette({R: 255, G: 140, B: 0, A: 255})
byGeometryColor_6 = Modifiers.GeometryColor.ByGeometryColor(geometry=code_block_24, color=color_palette_6)

# group: Team Preferences
code_block_142 = CodeBlock()
# ---------- code_block_142.designscript (3 lines) ----------
teamPreferencesDistraction = [0.4,0.7,0.5,0.3,0.1, 0.3, 0.7, 0.1];
teamPreferencesLight = [0.3,0.5,0.4,0.6,0.7,0.9,0.8,0.5];
teamSizes = [20, 18, 14, 8, 15, 20, 8, 14];
# ----------------------------------------

code_block_143 = CodeBlock(teamPreferencesLight=code_block_142.teamPreferencesLight) { teamPreferencesLight; }
code_block_144 = CodeBlock(teamPreferencesDistraction=code_block_142.teamPreferencesDistraction) { teamPreferencesDistraction; }
code_block_145 = CodeBlock(teamSizes=code_block_142.teamSizes) { teamSizes; }
code_block_146 = CodeBlock(windows=code_block_6) { windows; }

# group: Get Sun Positions
code_block_147 = CodeBlock()
# ---------- code_block_147.designscript (3 lines) ----------
[316.346000,283.232570,228.569863,156.082823,70.709867,-21.732681,-114.946843,-202.579060,-278.665368,376.338473,336.597419,273.854541,192.393427,97.769617,-3.563886,-104.696583,-198.731288,-279.254809,381.218058,346.618064,290.769871,217.370238,131.418186,38.767376,-54.272351,-141.357879,-216.572033];
[103.611928,35.390633,-27.737786,-81.470108,-122.145648,-146.993252,-154.320095,-143.628010,-115.644121,-15.835678,-89.809268,-157.476926,-214.253370,-256.272626,-280.674860,-285.801368,-271.325182,-238.203461,-120.993926,-188.985865,-251.651309,-304.682224,-344.467140,-368.296585,-374.547679,-362.796292,-333.839959];
[221.787683,280.226363,327.087806,359.166777,374.273370,371.376729,350.674395,313.580483,262.625304,134.605294,196.561626,245.366477,277.633324,291.145055,284.971791,259.530737,216.537574,158.983844,5.767315,64.344858,110.111311,141.134411,155.150410,151.177762,129.493429,91.634060,40.588621];
# ----------------------------------------
byCoordinates_12 = Point.ByCoordinates(x=code_block_147.out0, y=code_block_147.out1, z=code_block_147.out2)
code_block_148 = CodeBlock(sunLocations=byCoordinates_12) { sunLocations; }

# group: Sky Hemisphere Points
number_slider_17 = DoubleSlider(16.249, range=0..100 step 0.1)
number_slider_18 = DoubleSlider(-66.11, range=-66.11..100 step 0.1)
byCoordinates_13 = Point.ByCoordinates(x=number_slider_17, y=number_slider_18)
byOrigin_2 = CoordinateSystem.ByOrigin(origin=byCoordinates_13)
code_block_149 = CodeBlock { List.Flatten([-85..-20..#5, 20..85..#5], -1); -90..90..#10; 200; }
bySphericalCoordinates = Point.BySphericalCoordinates(cs=byOrigin_2, phi=code_block_149.out0, theta=code_block_149.out1, radius=code_block_149.out2, lacing=CrossProduct)
flatten_12 = List.Flatten(list=bySphericalCoordinates)
code_block_150 = CodeBlock(skyPoints=flatten_12) { skyPoints; }

# group: Combine Light Sources
direct_light_only = BoolSelector(true)
join_6 = List.Join(list0=code_block_148, list1=code_block_150)
scopeIf = ScopedIf(test=direct_light_only, true=code_block_148, false=join_6)
code_block_151 = CodeBlock(sunLocations=scopeIf) { sunLocations; }

code_block_152 = CodeBlock(neighborhoodSurfaces=code_block_30) { neighborhoodSurfaces; }

# group: Filter Visible Points
code_block_153 = CodeBlock(visibilityLattice=code_block_112) { visibilityLattice; }
points_2 = Core.SpaceLattice.Points(spaceLattice=code_block_153)
code_block_154 = CodeBlock(visibilityGrid=code_block_120) { visibilityGrid; }
valueAtPoint_2 = Visibility.VisibilityGrid.ValueAtPoint(visibilityGrid=code_block_154, point=points_2)
code_block_155 = CodeBlock { 0.1; }
gt_3 = valueAtPoint_2 > code_block_155
filterByBoolMask_9 = List.FilterByBoolMask(list=points_2, mask=gt_3)
code_block_156 = CodeBlock(visiblePoints=filterByBoolMask_9.in) { visiblePoints; }
flatten_13 = List.Flatten(list=code_block_156)
code_block_157 = CodeBlock(neighborhoodSurfaces=code_block_152) { neighborhoodSurfaces; }
python_script_4 = Python(IN[0]=flatten_13, IN[1]=code_block_157)
# ---------- python_script_4.python (22 lines) ----------
import sys
import clr
clr.AddReference('ProtoGeometry')
from Autodesk.DesignScript.Geometry import *

points = IN[0]
surfaces = IN[1]

groupedPoints = [[] for i in range(len(surfaces))]
otherPoints = []

for pt in points:
	pointAdded = False
	for i, s in enumerate(surfaces):
		if Geometry.DoesIntersect(s, pt):
			groupedPoints[i].append(pt)
			pointAdded = True
			break
	if not pointAdded:
		otherPoints.append(pt)

OUT = [otherPoints, groupedPoints]
# ----------------------------------------
code_block_158 = CodeBlock(groupedPoints=python_script_4) { groupedPoints; }

code_block_159 = CodeBlock(amenityCurves=code_block_59) { amenityCurves; }
code_block_160 = CodeBlock(amenityCurves=code_block_159) { amenityCurves; }
code_block_161 = CodeBlock(columnsAsRect=code_block_67) { columnsAsRect; }
code_block_162 = CodeBlock(parallelize=parallelize_metrics) { parallelize; }

# group: Calculate Daylight
code_block_163 = CodeBlock(windows=code_block_146) { windows; }
byJoinedSurfaces_3 = PolySurface.ByJoinedSurfaces(surfaces=code_block_163)
code_block_164 = CodeBlock(sunLocations=code_block_151) { sunLocations; }
code_block_165 = CodeBlock(visiblePoints=code_block_158) { visiblePoints; }
use_obstacles = BoolSelector(true)
use_rooms_as_obstacles = BoolSelector(true)
code_block_166 = CodeBlock(rooms=code_block_160) { rooms; }
ZAxis = Vector.ZAxis()
code_block_167 = CodeBlock { 5; }
extrudeAsSolid = Curve.ExtrudeAsSolid(curve=code_block_166, direction=ZAxis, distance=code_block_167)
code_block_168 = CodeBlock(columns=code_block_161) { columns; }
extrudeAsSolid_2 = Curve.ExtrudeAsSolid(curve=code_block_168, direction=ZAxis, distance=code_block_167)
join_7 = List.Join(list0=extrudeAsSolid, list1=extrudeAsSolid_2)
if_ = If(test=use_rooms_as_obstacles, true=join_7, false=extrudeAsSolid_2)
byUnion_2 = Solid.ByUnion(solids=if_)
code_block_169 = CodeBlock { null; }
if_2 = If(test=use_obstacles, true=byUnion_2, false=code_block_169)
code_block_170 = CodeBlock(windows=byJoinedSurfaces_3, sunLocations=code_block_164, points=code_block_165, obstacles=if_2) { windows; sunLocations; points; obstacles; }
code_block_171 = CodeBlock(parallelize=code_block_162) { parallelize; }
daylighting = Python(IN[0]=code_block_170.windows, IN[1]=code_block_170.sunLocations, IN[2]=code_block_170.points, IN[3]=code_block_170.obstacles, IN[4]=code_block_171)
# ---------- daylighting.python (42 lines) ----------
# Copyright (C) 2019 Autodesk Inc. 

import sys
import clr
clr.AddReference('ProtoGeometry')
from Autodesk.DesignScript.Geometry import *
from System.Threading.Tasks import *

# The inputs to this node will be stored as a list in the IN variables.
windowsSurface = IN[0]
sunLocations = IN[1]
points = IN[2]
obstacles = IN[3]
parallel = IN[4]

results_hallways = [0 for x in range(len(points[0]))]
results_neighborhoods = [0 for x in range(len(points[1]))]
for i, nbr in enumerate(points[1]):
	results_neighborhoods[i] = [0 for x in range(len(nbr))]

def calculateDaylight(point, index, results, sunLocations, windowsSurface, obstacles):
	c = 0
	for sun in sunLocations:
		sunRay = Line.ByStartPointEndPoint(point, sun)
		if Geometry.DoesIntersect(windowsSurface, sunRay):
			if not obstacles or not Geometry.DoesIntersect(obstacles, sunRay):
				c += 1
		sunRay.Dispose()
	results[index] = c;

if parallel:
	Parallel.ForEach(points[0], lambda point, state, i: calculateDaylight(point, i, results_hallways, sunLocations, windowsSurface, obstacles))
	for nbr, pts in enumerate(points[1]):
		Parallel.ForEach(pts, lambda point, state, i: calculateDaylight(point, i, results_neighborhoods[nbr], sunLocations, windowsSurface, obstacles))
else:
	for i, point in enumerate(points[0]):
		calculateDaylight(point, i, results_hallways, sunLocations, windowsSurface, obstacles)
	for nbr, pts in enumerate(points[1]):
		for i, point in enumerate(pts):
			calculateDaylight(point, i, results_neighborhoods[nbr], sunLocations, windowsSurface, obstacles)

OUT = [results_hallways, results_neighborhoods]
# ----------------------------------------
code_block_172 = CodeBlock(a=daylighting) { a[0]; a[1]; }
code_block_173 = CodeBlock(nbrhoodHits=code_block_172.out1) { nbrhoodHits; }
code_block_174 = CodeBlock(hallwayHits=code_block_172.out0) { hallwayHits; }
flatten_14 = List.Flatten(list=code_block_165)
code_block_175 = CodeBlock(points=flatten_14) { points; }
flatten_15 = List.Flatten(list=daylighting)
code_block_176 = CodeBlock(hitCount=flatten_15) { hitCount; }

# group: Approximate Daylight Metric
code_block_177 = CodeBlock(directSunHitCounts=code_block_173) { directSunHitCounts; }
code_block_178 = CodeBlock(sunTestPositions=code_block_151) { sunTestPositions; }
code_block_179 = CodeBlock(hallwayHits=code_block_174) { hallwayHits; }
code_block_180 = CodeBlock(directSunHitCounts=code_block_177, sunTestPositions=code_block_178, hallwayHits=code_block_179)
# ---------- code_block_180.designscript (9 lines) ----------
pointCount = List.Count(directSunHitCounts@L2<1>);
maxHits = List.Count(sunTestPositions) * pointCount * 0.75;
percentDirectHit = Math.Sum(directSunHitCounts@L2<1>) / maxHits;

hPointCount = List.Count(hallwayHits);
maxHitsHallway = List.Count(sunTestPositions) * hPointCount * 0.75;
percentDirectHitHallway = Math.Sum(hallwayHits) / maxHitsHallway;

Math.Average(List.Flatten([percentDirectHit, percentDirectHitHallway]));
# ----------------------------------------
code_block_181 = CodeBlock(neigborhoodDaylight=code_block_180.percentDirectHit) { neigborhoodDaylight; }
daylight = Watch(code_block_180.out6)  # graph output
code_block_182 = CodeBlock(daylight=code_block_180.out6) { daylight; }

# group: Visual Distraction Metric
code_block_183 = CodeBlock(visibilityLattice=code_block_122) { visibilityLattice; }
code_block_184 = CodeBlock(congestionMap=code_block_104) { congestionMap; }
code_block_185 = CodeBlock(deskPositions=code_block_123) { deskPositions; }
code_block_186 = CodeBlock(deskOrientations=code_block_124) { deskOrientations; }
closestPointTo_4 = Core.SpaceLattice.ClosestPointTo(spaceLattice=code_block_183, point=code_block_185)
max_view_radius = CodeBlock { visibilityRadius = 20; }
bySpaceLatticeAndViewPoint_2 = Visibility.ViewField.BySpaceLatticeAndViewPoint(spaceLattice=code_block_183, viewPoint=closestPointTo_4, radius=max_view_radius)
byViewField = Visibility.VisibilityGrid.ByViewField(viewField=bySpaceLatticeAndViewPoint_2)
average_2 = Math.Average(numbers=code_block_184)
average_3 = Math.Average(numbers=average_2)
code_block_187 = CodeBlock(a=average_3) { a/2; }
code_block_188 = CodeBlock(parallelize=parallelize_metrics) { parallelize; }
code_block_189 = CodeBlock(spaceLattice=code_block_183, congestionMap=code_block_184, deskPositions=code_block_185, deskOrientation=code_block_186, visibilityGrid=byViewField, congestionThreshold=code_block_187, nearbyThreshold=max_view_radius, parallelize=code_block_188)
# ---------- code_block_189.designscript (8 lines) ----------
spaceLattice;
congestionMap;
deskPositions;
deskOrientation;
visibilityGrid;
congestionThreshold;
nearbyThreshold;
parallelize;
# ----------------------------------------
congestion_distraction = Python(IN[0]=code_block_189.spaceLattice, IN[1]=code_block_189.congestionMap, IN[2]=code_block_189.deskPositions, IN[3]=code_block_189.deskOrientation, IN[4]=code_block_189.visibilityGrid, IN[5]=code_block_189.congestionThreshold, IN[6]=code_block_189.nearbyThreshold, IN[7]=code_block_189.parallelize)
# ---------- congestion_distraction.python (87 lines) ----------
# This script calculates congestion within a given visible radius.
import clr
import math
clr.AddReference('ProtoGeometry')
from Autodesk.DesignScript.Geometry import *
clr.AddReference('DSCoreNodes')
from DSCore import Math
from System.Threading.Tasks import *

# The inputs to this node will be stored as a list in the IN variables.
spaceLattice = IN[0]
congestionMap = IN[1]
deskPositions = IN[2]
deskOrientations = IN[3]
visibilityGrids = IN[4]
congestionThreshold = IN[5]
nearbyThreshold = IN[6]
parallel = IN[7]

# init results
results = []
for i in range(len(visibilityGrids)):
	results.append([])
	if len(visibilityGrids[i]) > 0:
		for j in range(len(visibilityGrids[i])):
			results[i].append(0)
	else:
		results[i].append(0)

def calculateScore(vGrid, i, nbr, results, spaceLattice, congestionMap, deskPositions, deskOrientations, congestionThreshold, nearbyThreshold):
    xCoordinates = spaceLattice.XCoordinates()
    yCoordinates = spaceLattice.YCoordinates()
    xCoordinatesLen = len(xCoordinates)
    yCoordinatesLen = len(yCoordinates)
    
    rangeMinX = xCoordinates[0]
    rangeMaxX = xCoordinates[xCoordinatesLen-1]
    rangeMinY = yCoordinates[0]
    rangeMaxY = yCoordinates[yCoordinatesLen-1]
    dp_i = deskPositions[nbr][i]
    do_i = deskOrientations[nbr][i]    
    totalPts = 0
    score = 0
    for xCoord in vGrid.XCoordinates():
        for yCoord in vGrid.YCoordinates():
            pt = Point.ByCoordinates(xCoord, yCoord)
            if(vGrid.ValueAtPoint(pt) > 0.1):
                
                global_x_coord = int(math.floor(Math.MapTo(rangeMinX, rangeMaxX, xCoord, 0, xCoordinatesLen-1)))
                global_y_coord = int(math.floor(Math.MapTo(rangeMinY, rangeMaxY, yCoord, 0, yCoordinatesLen-1)))
                congestion_value = congestionMap[global_x_coord][global_y_coord]
                if congestion_value > congestionThreshold:
                    vecToPoint = Vector.ByTwoPoints(dp_i, pt)
                    angle = do_i.AngleWithVector(vecToPoint)
                    distance = Geometry.DistanceTo(dp_i, pt)
                    if angle < 110 and visibilityGrids[nbr][i].ValueAtPoint(pt) > 0.1:
                        #nearby objects in periphery
                        if angle > 60 and distance <= nearbyThreshold/2.0:
                            score += 0.5
                        #distant objects in periphery
                        elif angle > 60:
                            score += 0.25
                        #nearby object in central cone
                        elif angle <= 60 and distance <= nearbyThreshold/2.0:
                            score += 1.0
                        #distant objects in central cone
                        else:
                            score += 0.5
                   	vecToPoint.Dispose()
               	    totalPts += 1
                
            pt.Dispose()
    if totalPts > 0:
        results[nbr][i] = score / totalPts;
    else:
        results[nbr][i] = 0
# Assign your output to the OUT variable.

if parallel:
	for nbr in range(len(visibilityGrids)):
		Parallel.ForEach(visibilityGrids[nbr], lambda vGrid, state, i: calculateScore(vGrid, i, nbr, results, spaceLattice, congestionMap, deskPositions, deskOrientations, congestionThreshold, nearbyThreshold))
else:
	for nbr in range(len(visibilityGrids)):
		for idx, vGrid in enumerate(visibilityGrids[nbr]):
			calculateScore(vGrid, idx, nbr, results, spaceLattice, congestionMap, deskPositions, deskOrientations, congestionThreshold, nearbyThreshold)

OUT = results
# ----------------------------------------
average_4 = Math.Average(numbers=congestion_distraction)
code_block_190 = CodeBlock(deskPositions=code_block_185, deskOrientations=code_block_186, visibilityGrid=byViewField, nearbyThreshold=max_view_radius, parallelize=code_block_188) { deskPositions; deskOrientations; visibilityGrid; nearbyThreshold; parallelize; }
neighbor_distraction = Python(IN[0]=code_block_190.deskPositions, IN[1]=code_block_190.deskOrientations, IN[2]=code_block_190.visibilityGrid, IN[3]=code_block_190.nearbyThreshold, IN[4]=code_block_190.parallelize)
# ---------- neighbor_distraction.python (66 lines) ----------
# Enable Python support and load DesignScript library
import clr
clr.AddReference('ProtoGeometry')
from Autodesk.DesignScript.Geometry import *
from System.Threading.Tasks import *
clr.AddReference('DSCoreNodes')
import DSCore
from DSCore import *

# The inputs to this node will be stored as a list in the IN variables.
deskPositions = IN[0]
deskOrientations = IN[1]
visibilityGrids = IN[2]
nearbyThreshold = IN[3]
parallel = IN[4]

# init results
results = []
for i in range(len(deskPositions)):
	results.append([])
	if len(visibilityGrids[i]) > 0:
		for j in range(len(visibilityGrids[i])):
			results[i].append(0)
	else:
		results[i].append(0)

def calculateScore(dp_i, do_i, i, nbr, results, deskPositions, deskOrientations, visibilityGrid, nearbyThreshold):
	score = 0
	totalPts = 0
	for j in range(len(deskPositions)):
		dp_j = deskPositions[j]
		do_j = deskOrientations[j]
		distance = Geometry.DistanceTo(dp_i, dp_j)
		if distance > 0.0001 and distance < nearbyThreshold:
			totalPts += 1
			vecToPoint = Vector.ByTwoPoints(dp_i, dp_j)
			angle = do_i.AngleWithVector(vecToPoint)
			if angle < 110 and visibilityGrid.ValueAtPoint(dp_j) > 0.1:
				#nearby objects in periphery
				if angle > 60 and distance <= nearbyThreshold/2.0:
					score += 0.5
				#distant objects in periphery
				elif angle > 60:
					score += 0.25
				#nearby object in central cone
				elif angle <= 60 and distance <= nearbyThreshold/2.0:
					score += 1.0
				#distant objects in central cone
				else:
					score += 0.5
			vecToPoint.Dispose()
	if totalPts > 0:
		results[nbr][i] = score / totalPts;
	else:
		results[nbr][i] = 0

if parallel:
	for nbr in range(len(deskPositions)):
		#Parallel.ForEach(deskPositions[nbr], lambda dp, state, i: calculateScore(dp, i, nbr, results, List.Flatten(deskPositions, -1), List.Flatten(deskOrientations, -1), visibilityGrids[nbr][i], nearbyThreshold))
		Parallel.ForEach(deskPositions[nbr], lambda dp, state, i: calculateScore(dp, deskOrientations[nbr][i], i, nbr, results, List.Flatten(deskPositions, -1), List.Flatten(deskOrientations, -1), visibilityGrids[nbr][i], nearbyThreshold))
else:
	for nbr in range(len(deskPositions)):
		for idx, dp in enumerate(deskPositions[nbr]):
			calculateScore(dp, deskOrientations[nbr][idx], idx, nbr, results, List.Flatten(deskPositions, -1), List.Flatten(deskOrientations, -1), visibilityGrids[nbr][idx], nearbyThreshold)

OUT = results
# ----------------------------------------
average_5 = Math.Average(numbers=neighbor_distraction)
code_block_191 = CodeBlock(a=average_4, b=average_5) { (a+b)/2; }
code_block_192 = CodeBlock(perNeiborhoodDistraction=code_block_191) { perNeiborhoodDistraction; }
average_6 = Math.Average(numbers=code_block_191)
distraction_min = Watch(average_6)  # graph output
code_block_193 = CodeBlock(distraction=distraction_min) { distraction; }
code_block_194 = CodeBlock(a=congestion_distraction, b=neighbor_distraction) { (a+b)/2; }
code_block_195 = CodeBlock(distractionPerDesk=code_block_194) { distractionPerDesk; }

code_block_196 = CodeBlock(deskCounts=code_block_78) { deskCounts; }
code_block_197 = CodeBlock(deskCounts=code_block_196) { deskCounts; }

# group: Team Placement & Work Style Metric
code_block_198 = CodeBlock(teamPreferencesLight=code_block_143) { teamPreferencesLight; }
code_block_199 = CodeBlock(teamPreferencesDistraction=code_block_144) { teamPreferencesDistraction; }
code_block_200 = CodeBlock { 0.0; }
code_block_201 = CodeBlock(teamSizes=code_block_145) { teamSizes; }
maximumItem_2 = List.MaximumItem(list=code_block_201)
map_2 = Math.Map(rangeMin=code_block_200, rangeMax=maximumItem_2, inputValue=code_block_201)
code_block_202 = CodeBlock(neighborhoodDaylightMetric=code_block_181) { neighborhoodDaylightMetric; }
code_block_203 = CodeBlock(neighborhoodDistractionMetric=code_block_192) { neighborhoodDistractionMetric; }
code_block_204 = CodeBlock(neighborhoodDeskCount=code_block_197) { neighborhoodDeskCount; }
map_3 = Math.Map(rangeMin=code_block_200, rangeMax=maximumItem_2, inputValue=code_block_204)
python_script_5 = Python(IN[0]=code_block_198, IN[1]=code_block_199, IN[2]=map_2, IN[3]=code_block_202, IN[4]=code_block_203, IN[5]=map_3)
# ---------- python_script_5.python (40 lines) ----------
import sys
import clr
import math
clr.AddReference('ProtoGeometry')
from Autodesk.DesignScript.Geometry import *

teamDaylightPreferences = IN[0]
teamDistractionPreferences = IN[1]
teamSizes = IN[2]
neighborhoodDaylightMetric = IN[3]
neighborhoodDistractionMetric = IN[4]
neighborhoodDeskCount = IN[5]

tID = range(len(teamSizes))
teamData = zip(tID, teamSizes, teamDaylightPreferences, teamDistractionPreferences)

nID = range(len(neighborhoodDeskCount))
nbrhoodData = zip(nID, neighborhoodDeskCount, neighborhoodDaylightMetric, neighborhoodDistractionMetric)

def cost_function(nbr, x):
	# Euclidean distance
	d = nbr[1]-x[1]
	return math.sqrt(((d)**2 + (nbr[2]-x[2])**2 + (nbr[3]-x[3])**2)/3)

assignedTeamIDs = []
assignedCosts = []

for i,nbr in enumerate(nbrhoodData):
	costs = map(lambda x: cost_function(nbr, x), teamData)
	#unzip data to add costs to list
	tD = zip(*teamData)	
	tData = zip(costs, tD[0], tD[1], tD[2], tD[3])
	tData.sort(key=lambda x: x[0], reverse=False) 
	assignedTeamIDs.append(tData[0][1])
	assignedCosts.append(tData[0][0])
	# remove team that with current id
	id = map(lambda c: c[0] == tData[0][1], teamData).index(True)
	del teamData[id]
	
OUT = [assignedTeamIDs, assignedCosts]
# ----------------------------------------
code_block_205 = CodeBlock(a=python_script_5) { a[0]; a[1]; }
code_block_206 = CodeBlock(a=code_block_205.out1) { 1 - a; }
average_7 = Math.Average(numbers=code_block_206)
work_style = Watch(average_7)  # graph output
code_block_207 = CodeBlock(assignments=code_block_205.out0) { assignments; }
code_block_208 = CodeBlock(workStyle=average_7) { workStyle; }
code_block_209 = CodeBlock(workStylePerTeam=code_block_206) { workStylePerTeam; }

# group: Adjacency Metric
code_block_210 = CodeBlock(pathLengths=code_block_96) { pathLengths; }
average_8 = Math.Average(numbers=code_block_210)
adjacency_min = Watch(average_8)  # graph output

# group: Combine and Normalize Metrics
code_block_211 = CodeBlock { ["Adjacency", "Buzz", "Distraction", "Views to Outside", "Daylight", "Work Style"]; }
code_block_212 = CodeBlock(metricNames=code_block_211) { metricNames; }
code_block_213 = CodeBlock(adjacency=adjacency_min) { adjacency; }
code_block_214 = CodeBlock(buzz=code_block_105) { buzz; }
code_block_215 = CodeBlock(distraction=code_block_193) { distraction; }
code_block_216 = CodeBlock(viewsToOutside=code_block_137) { viewsToOutside; }
code_block_217 = CodeBlock(daylight=code_block_182) { daylight; }
code_block_218 = CodeBlock(workStyle=code_block_208) { workStyle; }
list_create_13 = List.Create(item0=code_block_213, item1=code_block_214, item2=code_block_215, item3=code_block_216, item4=code_block_217, item5=code_block_218)
code_block_219 = CodeBlock(combinedMetrics=list_create_13) { combinedMetrics; }
# note: Min and max values for each metric. Reverse the min and the max if the metric is minimized, such as with Adjacency and Distraction.
code_block_220 = CodeBlock { metricMins = [300, 0, 1, 0, 0, 0]; metricMaxs = [0, 10, 0, 1, 1, 1]; }
map_4 = Math.Map(rangeMin=code_block_220.metricMins, rangeMax=code_block_220.metricMaxs, inputValue=list_create_13)
code_block_221 = CodeBlock(normalizedMetrics=map_4) { normalizedMetrics; }

# group: Display Metrics as Text
code_block_222 = CodeBlock(names=code_block_212) { names; }
count_5 = List.Count(list=code_block_222)
code_block_223 = CodeBlock(count=count_5) { 1..count; }
string_from_object = FromObject(obj=code_block_223)
code_block_224 = CodeBlock(values=code_block_219) { values; }
string_from_object_2 = FromObject(obj=code_block_224)
code_block_225 = CodeBlock { x = -30; y = -50; height = 3; }
code_block_226 = CodeBlock(index=string_from_object, name=code_block_222, value=string_from_object_2, offset=code_block_225.x, start=code_block_225.y, height=code_block_225.height, i=code_block_223) { index + ". " + name + ": " + value; Point.ByCoordinates(offset, start - (height * (i - 1))); }
code_block_227 = CodeBlock { 2; }
fromStringOriginAndScale = DynamoText.Text.FromStringOriginAndScale(text=code_block_226.out0, origin=code_block_226.out1, scale=code_block_227)
code_block_228 = CodeBlock(metricsText=fromStringOriginAndScale) { metricsText; }

# group: Display Radar Graph
x_offset = DoubleSlider(11.5, range=0..50 step 0.1)
add = code_block_225.x + x_offset
y_offset = DoubleSlider(29.4, range=0..50 step 0.1)
sub = code_block_225.y - y_offset
byCoordinates_14 = Point.ByCoordinates(x=add, y=sub)
code_block_229 = CodeBlock(position=byCoordinates_14) { position; }
size = DoubleSlider(10.6, range=1..20 step 0.1)
code_block_230 = CodeBlock { bands = 4; }
code_block_231 = CodeBlock(size=size, bands=code_block_230) { 0..size..#bands+2; }
restOfItems = List.RestOfItems(list=code_block_231)
byCenterPointRadius = Circle.ByCenterPointRadius(centerPoint=code_block_229, radius=restOfItems, lacing=Longest)
code_block_232 = CodeBlock(normalizedMetrics=code_block_221) { normalizedMetrics; }
count_6 = List.Count(list=code_block_232)
regularPolygon = Polygon.RegularPolygon(circle=byCenterPointRadius, numberSides=count_6)
ZAxis_2 = Vector.ZAxis()
code_block_233 = CodeBlock { 90; }
rotate = Geometry.Rotate(geometry=regularPolygon, origin=code_block_229, axis=ZAxis_2, degrees=code_block_233)
reverse = List.Reverse(list=rotate)
restOfItems_2 = List.RestOfItems(list=reverse)
firstItem_2 = List.FirstItem(list=restOfItems_2)
code_block_234 = CodeBlock(outerPolygon=firstItem_2) { outerPolygon; }
points_3 = Polygon.Points(polygon=firstItem_2)
byStartPointEndPoint_3 = Line.ByStartPointEndPoint(startPoint=code_block_229, endPoint=points_3)
restOfItems_3 = List.RestOfItems(list=restOfItems_2)
join_8 = List.Join(list0=byStartPointEndPoint_3, list1=restOfItems_3)
color_palette_7 = ColorPalette({R: 192, G: 192, B: 192, A: 255})
byGeometryColor_7 = Modifiers.GeometryColor.ByGeometryColor(geometry=join_8, color=color_palette_7)
code_block_235 = CodeBlock(innerPolygonsAndRadialLines=byGeometryColor_7) { innerPolygonsAndRadialLines; }
pointAtParameter_5 = Curve.PointAtParameter(curve=byStartPointEndPoint_3, param=code_block_232)
byPoints_4 = Polygon.ByPoints(points=pointAtParameter_5)
byPatch_6 = Surface.ByPatch(closedCurve=byPoints_4)
color_palette_8 = ColorPalette({R: 135, G: 206, B: 250, A: 255})
byGeometryColor_8 = Modifiers.GeometryColor.ByGeometryColor(geometry=byPatch_6, color=color_palette_8)
code_block_236 = CodeBlock(radarChartFill=byGeometryColor_8) { radarChartFill; }
code_block_237 = CodeBlock(radarChartOutline=byPoints_4) { radarChartOutline; }
code_block_238 = CodeBlock(count=count_6) { 1..count; }
string_from_object_3 = FromObject(obj=code_block_238)
lastItem = List.LastItem(list=rotate)
points_4 = Polygon.Points(polygon=lastItem)
code_block_239 = CodeBlock { 1.8; }
fromStringOriginAndScale_2 = DynamoText.Text.FromStringOriginAndScale(text=string_from_object_3, origin=points_4, scale=code_block_239)
byGeometry_3 = BoundingBox.ByGeometry(geom=fromStringOriginAndScale_2)
maxPoint = BoundingBox.MaxPoint(boundingBox=byGeometry_3)
minPoint = BoundingBox.MinPoint(boundingBox=byGeometry_3)
asVector = Point.AsVector(point=minPoint)
subtract = Point.Subtract(point=maxPoint, vectorToSubtract=asVector)
X = Point.X(point=subtract)
code_block_240 = CodeBlock { -2; }
div = X / code_block_240
Y = Point.Y(point=subtract)
div_2 = Y / code_block_240
translate_3 = Geometry.Translate(geometry=fromStringOriginAndScale_2, xTranslation=div, yTranslation=div_2)
code_block_241 = CodeBlock(numberText=translate_3) { numberText; }
code_block_242 = CodeBlock(outerPolygonPoints=points_4) { outerPolygonPoints; }

legend = List.Create(item0=code_block_228, item1=code_block_234, item2=code_block_235, item3=code_block_236, item4=code_block_237, item5=code_block_241)
code_block_243 = CodeBlock { ["Distraction", "Adjacency/Buzz (Congestion Map)", "Daylight", "Views to Outside", "Work Style"]; }

# group: Display Labels
code_block_244 = CodeBlock(names=code_block_243) { names; }
code_block_245 = CodeBlock { x = 20; y = -18; width = 40; }
count_7 = List.Count(list=code_block_244)
code_block_246 = CodeBlock(count=count_7) { 1..count; }
code_block_247 = CodeBlock(offset=code_block_245.x, width=code_block_245.width, i=code_block_246, start=code_block_245.y) { Point.ByCoordinates(offset + (width * (i - 1)), start); }
code_block_248 = CodeBlock { 2; }
fromStringOriginAndScale_3 = DynamoText.Text.FromStringOriginAndScale(text=code_block_244, origin=code_block_247, scale=code_block_248)
byGeometry_4 = BoundingBox.ByGeometry(geom=fromStringOriginAndScale_3)
maxPoint_2 = BoundingBox.MaxPoint(boundingBox=byGeometry_4)
minPoint_2 = BoundingBox.MinPoint(boundingBox=byGeometry_4)
asVector_2 = Point.AsVector(point=minPoint_2)
subtract_2 = Point.Subtract(point=maxPoint_2, vectorToSubtract=asVector_2)
X_2 = Point.X(point=subtract_2)
code_block_249 = CodeBlock { -2; }
div_3 = X_2 / code_block_249
translate_4 = Geometry.Translate(geometry=fromStringOriginAndScale_3, xTranslation=div_3)
code_block_250 = CodeBlock(labels=translate_4) { labels; }

code_block_251 = CodeBlock(pathLattice=code_block_99) { pathLattice; }

# group: Define Visibility/Buzz Colors
code_block_252 = CodeBlock()
# ---------- code_block_252.designscript (9 lines) ----------
DSCore.Color.ByARGB(255,0, 0, 4);
DSCore.Color.ByARGB(255,28, 16, 68);
DSCore.Color.ByARGB(255,79, 18, 123);
DSCore.Color.ByARGB(255,129, 37, 129);
DSCore.Color.ByARGB(255,181, 54, 122);
DSCore.Color.ByARGB(255,229, 89, 100);
DSCore.Color.ByARGB(255,251, 135, 97);
DSCore.Color.ByARGB(255,254, 194, 135);
DSCore.Color.ByARGB(255,251, 253, 191);
# ----------------------------------------
list_create_14 = List.Create(item0=code_block_252.out0, item1=code_block_252.out1, item2=code_block_252.out2, item3=code_block_252.out3, item4=code_block_252.out4, item5=code_block_252.out5, item6=code_block_252.out6, item7=code_block_252.out7, item8=code_block_252.out8)
code_block_253 = CodeBlock(colors=list_create_14) { colors; }

# group: Display Congestion Values
code_block_254 = CodeBlock(congestionMap=code_block_104) { congestionMap; }
code_block_255 = CodeBlock(t2=code_block_254) { t1 = DSCore.List.Flatten(t2, -1); t3 = DSCore.List.MaximumItem(t1); }  # frozen
code_block_256 = CodeBlock(spaceLattice=code_block_251) { spaceLattice; }
surface = Core.SpaceLattice.Surface(spaceLattice=code_block_256)
code_block_257 = CodeBlock { 40; 0; }
translate_5 = Geometry.Translate(geometry=surface, xTranslation=code_block_257.out0, yTranslation=code_block_257.out1, zTranslation=code_block_257.out1)
code_block_258 = CodeBlock(colors=code_block_253) { colors; }
reverse_2 = List.Reverse(list=code_block_258)
code_block_259 = CodeBlock { 0..1..#9; }
code_block_260 = CodeBlock { 0; 20; }
map_5 = Math.Map(rangeMin=code_block_260.out0, rangeMax=code_block_260.out1, inputValue=code_block_254)
color_range = ColorRange(colors=reverse_2, indices=code_block_259, value=map_5)
bySurfaceColors = Modifiers.GeometryColor.BySurfaceColors(surface=translate_5, colors=color_range)
code_block_261 = CodeBlock(congestion=bySurfaceColors) { congestion; }

code_block_262 = CodeBlock(columnsAsRect=code_block_161) { columnsAsRect; }
code_block_263 = CodeBlock(columnsAsRect=code_block_262) { columnsAsRect; }
code_block_264 = CodeBlock(columnsAsRect=code_block_263) { columnsAsRect; }
code_block_265 = CodeBlock(amenitySpaces=code_block_106) { amenitySpaces; }
code_block_266 = CodeBlock(amenitySpaces=code_block_265) { amenitySpaces; }
code_block_267 = CodeBlock(amenitySpaces=code_block_266) { amenitySpaces; }

# group: Define Daylight Colors
code_block_268 = CodeBlock()
# ---------- code_block_268.designscript (8 lines) ----------
DSCore.Color.ByARGB(255,108, 28, 130);
DSCore.Color.ByARGB(255,111, 38, 231);
DSCore.Color.ByARGB(255,48, 42, 251);
DSCore.Color.ByARGB(255,102, 162, 251);
DSCore.Color.ByARGB(255,154, 250, 247);
DSCore.Color.ByARGB(255,168, 250, 117);
DSCore.Color.ByARGB(255,253, 254, 43);
DSCore.Color.ByARGB(255,253, 254, 43);
# ----------------------------------------
list_create_15 = List.Create(item0=code_block_268.out0, item1=code_block_268.out1, item2=code_block_268.out2, item3=code_block_268.out3, item4=code_block_268.out4, item5=code_block_268.out5, item6=code_block_268.out6, item7=code_block_268.out7)
code_block_269 = CodeBlock(colors=list_create_15) { colors; }

# group: Display Daylight Values
code_block_270 = CodeBlock(columnsAsRect=code_block_264) { columnsAsRect; }
byPatch_7 = Surface.ByPatch(closedCurve=code_block_270)
code_block_271 = CodeBlock(amenitySpaces=code_block_267) { amenitySpaces; }
list_create_16 = List.Create(item0=byPatch_7, item1=code_block_271)
code_block_272 = CodeBlock { 80; 0; }
translate_6 = Geometry.Translate(geometry=list_create_16, xTranslation=code_block_272.out0, yTranslation=code_block_272.out1, zTranslation=code_block_272.out1)
color_palette_9 = ColorPalette({R: 0, G: 0, B: 0, A: 255})
byGeometryColor_9 = Modifiers.GeometryColor.ByGeometryColor(geometry=translate_6, color=color_palette_9)
code_block_273 = CodeBlock(points=code_block_175) { points; }
byOrigin_3 = CoordinateSystem.ByOrigin(origin=code_block_273)
code_block_274 = CodeBlock { 1; }
byWidthLength_2 = Rectangle.ByWidthLength(cs=byOrigin_3, width=code_block_274, length=code_block_274)
byPatch_8 = Surface.ByPatch(closedCurve=byWidthLength_2)
translate_7 = Geometry.Translate(geometry=byPatch_8, xTranslation=code_block_272.out0, yTranslation=code_block_272.out1, zTranslation=code_block_272.out1)
code_block_275 = CodeBlock(colors=code_block_269) { colors; }
code_block_276 = CodeBlock { 0..1..#8; }
code_block_277 = CodeBlock(sunTestPositions=code_block_151) { sunTestPositions; }
code_block_278 = CodeBlock(sunTestPositions=code_block_277) { 0; List.Count(sunTestPositions) * 0.5; }
code_block_279 = CodeBlock(values=code_block_176) { values; }
map_6 = Math.Map(rangeMin=code_block_278.out0, rangeMax=code_block_278.out1, inputValue=code_block_279)
color_range_2 = ColorRange(colors=code_block_275, indices=code_block_276, value=map_6)
byGeometryColor_10 = Modifiers.GeometryColor.ByGeometryColor(geometry=translate_7, color=color_range_2)
join_9 = List.Join(list0=byGeometryColor_9, list1=byGeometryColor_10)
code_block_280 = CodeBlock(daylight=join_9) { daylight; }

code_block_281 = CodeBlock(windowsAsLines=code_block_12) { windowsAsLines; }
code_block_282 = CodeBlock(windowsAsLines=code_block_281) { windowsAsLines; }
code_block_283 = CodeBlock(orientations=code_block_124) { orientations; }

# group: Views To Outside
code_block_284 = CodeBlock(columnsAsRect=code_block_264) { columnsAsRect; }
byPatch_9 = Surface.ByPatch(closedCurve=code_block_284)
code_block_285 = CodeBlock(amenitySpaces=code_block_267) { amenitySpaces; }
list_create_17 = List.Create(item0=byPatch_9, item1=code_block_285)
code_block_286 = CodeBlock { 120; 0; }
translate_8 = Geometry.Translate(geometry=list_create_17, xTranslation=code_block_286.out0, yTranslation=code_block_286.out1, zTranslation=code_block_286.out1)
color_palette_10 = ColorPalette({R: 192, G: 192, B: 192, A: 255})
byGeometryColor_11 = Modifiers.GeometryColor.ByGeometryColor(geometry=translate_8, color=color_palette_10)
code_block_287 = CodeBlock(windowsAsLines=code_block_282) { windowsAsLines; }
code_block_288 = CodeBlock(desks=code_block_138) { desks; }
code_block_289 = CodeBlock(windowPts=code_block_139) { windowPts; }
code_block_290 = CodeBlock(a=code_block_289) { a == 0; }
filterByBoolMask_10 = List.FilterByBoolMask(list=code_block_288, mask=code_block_290)
list_create_18 = List.Create(item0=code_block_287, item1=filterByBoolMask_10.out)
translate_9 = Geometry.Translate(geometry=list_create_18, xTranslation=code_block_286.out0, yTranslation=code_block_286.out1, zTranslation=code_block_286.out1)
code_block_291 = CodeBlock(orientations=code_block_283) { orientations; }
flatten_16 = List.Flatten(list=code_block_291)
code_block_292 = CodeBlock(rawDists=code_block_140) { rawDists; }
python_script_6 = Python(IN[0]=code_block_288, IN[1]=flatten_16, IN[2]=code_block_292, IN[3]=code_block_289)
# ---------- python_script_6.python (44 lines) ----------
import sys
import clr
clr.AddReference('ProtoGeometry')
from Autodesk.DesignScript.Geometry import *

# The inputs to this node will be stored as a list in the IN variables.
pts = IN[0]
dirs = IN[1]
dists = IN[2]
windows = IN[2]
curves = []
curves2 = []

for i, pt in enumerate(pts):
	dir = dirs[i]
	v1 = Vector.Rotate(dir, Vector.ZAxis(), -110)
	v2 = Vector.Rotate(dir, Vector.ZAxis(), 110)
	if windows[i] == 0:
		v3 = v1.Scale(0.8)
		v4 = v2.Scale(0.8)
	else:
		v3 = v1.Scale(1.0)
		v4 = v2.Scale(1.0)
	sPt = Point.Add(pt, v3)
	ePt = Point.Add(pt, v4)
	arc = Arc.ByCenterPointStartPointEndPoint(pt, sPt, ePt)
	line1 = Line.ByStartPointEndPoint(sPt, pt)
	line2 = Line.ByStartPointEndPoint(pt, ePt) 
	pc = PolyCurve.ByJoinedCurves([line1, line2, arc], 0.001)
	sPt.Dispose()
	ePt.Dispose()
	v1.Dispose()
	v2.Dispose()
	v3.Dispose()
	v4.Dispose()
	line1.Dispose()
	line2.Dispose()
	if windows[i] == 0:
		curves2.append(pc)
	else:
		curves.append(pc)
	

OUT = [curves, curves2]
# ----------------------------------------
code_block_293 = CodeBlock(a=python_script_6) { a[0]; a[1]; }
byPatch_10 = Surface.ByPatch(closedCurve=code_block_293.out0)
filterByBoolMask_11 = List.FilterByBoolMask(list=code_block_288, mask=code_block_290)
filterByBoolMask_12 = List.FilterByBoolMask(list=code_block_289, mask=code_block_290)
byStartPointEndPoint_4 = Line.ByStartPointEndPoint(startPoint=filterByBoolMask_11.out, endPoint=filterByBoolMask_12.out)
list_create_19 = List.Create(item0=byPatch_10, item1=byStartPointEndPoint_4)
translate_10 = Geometry.Translate(geometry=list_create_19, xTranslation=code_block_286.out0, yTranslation=code_block_286.out1, zTranslation=code_block_286.out1)
code_block_294 = CodeBlock()
# ---------- code_block_294.designscript (3 lines) ----------
[DSCore.Color.ByARGB(55, 255, 0, 0),
DSCore.Color.ByARGB(55, 0, 255, 0)];
[0, 1];
# ----------------------------------------
code_block_295 = CodeBlock(viewsToOutside=code_block_141) { viewsToOutside; }
color_range_3 = ColorRange(colors=code_block_294.out0, indices=code_block_294.out1, value=code_block_295)
filterByBoolMask_13 = List.FilterByBoolMask(list=color_range_3, mask=code_block_290)
list_create_20 = List.Create(item0=filterByBoolMask_13.out, item1=filterByBoolMask_13.out)
byGeometryColor_12 = Modifiers.GeometryColor.ByGeometryColor(geometry=translate_10, color=list_create_20)
translate_11 = Geometry.Translate(geometry=code_block_293.out1, xTranslation=code_block_286.out0, yTranslation=code_block_286.out1, zTranslation=code_block_286.out1)
byGeometryColor_13 = Modifiers.GeometryColor.ByGeometryColor(geometry=translate_11, color=filterByBoolMask_13.in)
join_10 = List.Join(list0=byGeometryColor_11, list1=translate_9, list2=byGeometryColor_12, list3=byGeometryColor_13)
code_block_296 = CodeBlock(viewsToOutside=join_10) { viewsToOutside; }

code_block_297 = CodeBlock(deskPts=code_block_123) { deskPts; }
code_block_298 = CodeBlock(distraction=code_block_195) { distraction; }
code_block_299 = CodeBlock(deskRects=code_block_79) { deskRects; }

# group: Display Distraction
code_block_300 = CodeBlock(desks=code_block_297) { desks; }
code_block_301 = CodeBlock { 0.5; }
byCenterPointRadius_2 = Circle.ByCenterPointRadius(centerPoint=code_block_300, radius=code_block_301)
byPatch_11 = Surface.ByPatch(closedCurve=byCenterPointRadius_2)
code_block_302 = CodeBlock()
# ---------- code_block_302.designscript (3 lines) ----------
[DSCore.Color.ByARGB(255, 0, 255, 0),
 DSCore.Color.ByARGB(255, 255, 0, 0)];
[0, 1];
# ----------------------------------------
code_block_303 = CodeBlock(distraction=code_block_298) { distraction; }
color_range_4 = ColorRange(colors=code_block_302.out0, indices=code_block_302.out1, value=code_block_303)
code_block_304 = CodeBlock(colors=color_range_4) { colors; }
byGeometryColor_14 = Modifiers.GeometryColor.ByGeometryColor(geometry=byPatch_11, color=code_block_304)
code_block_305 = CodeBlock(desks=code_block_299) { desks; }
byPatch_12 = Surface.ByPatch(closedCurve=code_block_305)
byGeometryColor_15 = Modifiers.GeometryColor.ByGeometryColor(geometry=byPatch_12, color=code_block_304)
list_create_21 = List.Create(item0=byGeometryColor_14, item1=byGeometryColor_15)
code_block_306 = CodeBlock(distraction=list_create_21) { distraction; }

code_block_307 = CodeBlock(neighborhoodSurfaces=code_block_152) { neighborhoodSurfaces; }

# group: Display Work Style
code_block_308 = CodeBlock(nbrhoods=code_block_307) { nbrhoods; }
code_block_309 = CodeBlock { 160; 0; }
translate_12 = Geometry.Translate(geometry=code_block_308, xTranslation=code_block_309.out0, yTranslation=code_block_309.out1, zTranslation=code_block_309.out1)
code_block_310 = CodeBlock { ["f03b20", "#ffff11","#2ca25f"]; }
code_block_311 = CodeBlock { 255; }
hex_to_colors = Python(IN[0]=code_block_310, IN[1]=code_block_311)
# ---------- hex_to_colors.python (14 lines) ----------
import sys
import clr
clr.AddReference('ProtoGeometry')
clr.AddReference('DSCoreNodes')
from Autodesk.DesignScript.Geometry import *
import DSCore

hexList = IN[0]
alpha = IN[1]
def HEXToRGB(hex):
	h = hex.lstrip('#')
	rgb = tuple(int(h[i:i+2], 16) for i in (0, 2, 4))
	return DSCore.Color.ByARGB(alpha, rgb[0], rgb[1], rgb[2])
OUT = map(HEXToRGB, hexList)
# ----------------------------------------
code_block_312 = CodeBlock { 0..2; }
code_block_313 = CodeBlock(workstyle=code_block_209) { workstyle; }
color_range_5 = ColorRange(colors=hex_to_colors, indices=code_block_312, value=code_block_313)
code_block_314 = CodeBlock(colors=color_range_5) { colors; }
byGeometryColor_16 = Modifiers.GeometryColor.ByGeometryColor(geometry=translate_12, color=code_block_314)
code_block_315 = CodeBlock(windowsAsLines=code_block_282) { windowsAsLines; }
translate_13 = Geometry.Translate(geometry=code_block_315, xTranslation=code_block_309.out0, yTranslation=code_block_309.out1, zTranslation=code_block_309.out1)
join_11 = List.Join(list0=byGeometryColor_16, list1=translate_13)
code_block_316 = CodeBlock(workstyle=join_11) { workstyle; }

# group: Display Landmarks
code_block_317 = CodeBlock { 0.3; }
byCenterPointRadius_3 = Circle.ByCenterPointRadius(centerPoint=code_block_81, radius=code_block_317)
code_block_318 = CodeBlock { 4; }
regularPolygon_2 = Polygon.RegularPolygon(circle=byCenterPointRadius_3, numberSides=code_block_318)
color_palette_11 = ColorPalette({R: 255, G: 0, B: 255, A: 255})
byGeometryColor_17 = Modifiers.GeometryColor.ByGeometryColor(geometry=regularPolygon_2, color=color_palette_11)

code_block_319 = CodeBlock(landmarkDisplay=byGeometryColor_17) { landmarkDisplay; }

# group: Display Column System
color_palette_12 = ColorPalette({R: 0, G: 0, B: 0, A: 136})
byGeometryColor_18 = Modifiers.GeometryColor.ByGeometryColor(geometry=code_block_64, color=color_palette_12)

code_block_320 = CodeBlock(columnDisplay=byGeometryColor_18) { columnDisplay; }
code_block_321 = CodeBlock(windows=byGeometryColor_5) { windows; }
code_block_322 = CodeBlock(amenity=byGeometryColor_2) { amenity; }

# group: Display Neighborhoods
perimeterCurves_5 = Surface.PerimeterCurves(surface=code_block_152)
color_palette_13 = ColorPalette({R: 192, G: 192, B: 192, A: 255})
byGeometryColor_19 = Modifiers.GeometryColor.ByGeometryColor(geometry=perimeterCurves_5, color=color_palette_13)

code_block_323 = CodeBlock(neighborhoodsDisplay=byGeometryColor_19) { neighborhoodsDisplay; }
list_join_reduced = List.Join(list0=code_block_321, list1=code_block_322, list2=code_block_323)
all_metrics = List.Create(item0=legend, item1=code_block_250, item2=code_block_261, item3=code_block_280, item4=code_block_296, item5=code_block_306, item6=code_block_316, item7=code_block_319, item8=code_block_320, item9=list_join_reduced)
join_12 = List.Join(list0=legend, list1=list_join_reduced, list2=code_block_322)
