# Dynamo graph spaceanalysis-carleton-university-north-campus.dyn (Dynamo 2.0.2.6826)

# note: Variables / Inputs
# Variables that can be altered per project and must be set accordingly before running the script.
# note: Metrics / Goals / Outputs
# Logic associated with calculating goals, metrics, outputs .
# note: Working / Functions
# Core working of the script.
# note: Display / Visualization
# Logic used simply for visualization purposes, and doesn't contain core logic.

# group: Carleton University - North Campus
# note: DYNAMO PROJECT
# spaceanalysis-pathfinding-05-carleton-university-north-campus.dyn
# note: ASSOCIATED FILE(S)
# N/A
# note: AUTHOR(S) / CREATION DATE
# Autodesk Complex Systems Research Group / 2019
# note: DESCRIPTION
# Example project description.
# note: DYNAMO VERSION
# 2.0.2
# note: ADDITIONAL COMMENTS
# N/A
# note: REQUIRED DYNAMO PACKAGES
# SpaceAnalysis

# group: Load & Visualize Carleton Campus Context Map
file_path = Filename("carletonUniversityContext\buildingShapes.sat")
importFromSAT = Geometry.ImportFromSAT(filePath=file_path)
color_palette = ColorPalette({R: 100, G: 149, B: 237, A: 149})
byGeometryColor = Modifiers.GeometryColor.ByGeometryColor(geometry=importFromSAT, color=color_palette)
file_path_2 = Filename("carletonUniversityContext\roadShapes.sat")
importFromSAT_2 = Geometry.ImportFromSAT(filePath=file_path_2)
byOriginNormal = Plane.ByOriginNormal()
intersect = Geometry.Intersect(geometry=importFromSAT_2, other=byOriginNormal)
color_palette_2 = ColorPalette({R: 83, G: 83, B: 83, A: 41})
byGeometryColor_2 = Modifiers.GeometryColor.ByGeometryColor(geometry=intersect, color=color_palette_2)
file_path_3 = Filename("carletonUniversityContext\sidewalkShapes.sat")
importFromSAT_3 = Geometry.ImportFromSAT(filePath=file_path_3)
color_palette_3 = ColorPalette({R: 141, G: 141, B: 141, A: 79})
byGeometryColor_3 = Modifiers.GeometryColor.ByGeometryColor(geometry=importFromSAT_3, color=color_palette_3)
file_path_4 = Filename("carletonUniversityContext\tree (small) with trunk.sat")
importFromSAT_4 = Geometry.ImportFromSAT(filePath=file_path_4)
ZAxis = Vector.ZAxis()
project = Curve.Project(curve=importFromSAT_4, baseGeometry=byOriginNormal, projectionDirection=ZAxis)
color_palette_4 = ColorPalette({R: 28, G: 161, B: 8, A: 34})
byGeometryColor_4 = Modifiers.GeometryColor.ByGeometryColor(geometry=project, color=color_palette_4)
flatten = List.Flatten(list=project)
code_block = CodeBlock(trees=flatten) { trees; }

# group: Boundary Points
code_block_2 = CodeBlock { [-10.273,9.273,-4,-9.361,-18.109,-26.378]; [62.074,73.997,99.086,100.468,91.951,79.873]; }
byCoordinates = Point.ByCoordinates(x=code_block_2.out0, y=code_block_2.out1)
code_block_3 = CodeBlock(boundaryPoints=byCoordinates) { boundaryPoints; }

code_block_4 = CodeBlock(boundaryPoints=code_block_3) { boundaryPoints; }

# group: Boundary Lines
code_block_5 = CodeBlock(boundaryPoints=code_block_3) { boundaryPoints; }
code_block_6 = CodeBlock { 0; 1; 2; 5; }
getItemAtIndex = List.GetItemAtIndex(list=code_block_5, index=code_block_6.out0)
getItemAtIndex_2 = List.GetItemAtIndex(list=code_block_5, index=code_block_6.out3)
byStartPointEndPoint = Line.ByStartPointEndPoint(startPoint=getItemAtIndex, endPoint=getItemAtIndex_2)
getItemAtIndex_3 = List.GetItemAtIndex(list=code_block_5, index=code_block_6.out1)
getItemAtIndex_4 = List.GetItemAtIndex(list=code_block_5, index=code_block_6.out2)
byStartPointEndPoint_2 = Line.ByStartPointEndPoint(startPoint=getItemAtIndex_3, endPoint=getItemAtIndex_4)
byStartPointEndPoint_3 = Line.ByStartPointEndPoint(startPoint=getItemAtIndex, endPoint=getItemAtIndex_3)
byStartPointEndPoint_4 = Line.ByStartPointEndPoint(startPoint=getItemAtIndex_2, endPoint=getItemAtIndex_4)
byStartPointEndPoint_5 = Line.ByStartPointEndPoint(startPoint=getItemAtIndex_2, endPoint=getItemAtIndex)

# group: Main Plaza Parameters
plaza_x_position_parameter = DoubleSlider(0.5345925655, range=0..1 step 0.1)  # graph input
plaza_y_position_parameter = DoubleSlider(0.5955695973, range=0..1 step 0.1)  # graph input
plaza_width = DoubleSlider(0.5893205915, range=0.1..0.9 step 0.1)  # graph input
plaza_length = DoubleSlider(0.7154253852, range=0.1..0.9 step 0.1)  # graph input

# group: Main Plaza Position
pointAtParameter = Curve.PointAtParameter(curve=byStartPointEndPoint, param=plaza_x_position_parameter)
pointAtParameter_2 = Curve.PointAtParameter(curve=byStartPointEndPoint_2, param=plaza_x_position_parameter)
byStartPointEndPoint_6 = Line.ByStartPointEndPoint(startPoint=pointAtParameter, endPoint=pointAtParameter_2)
pointAtParameter_3 = Curve.PointAtParameter(curve=byStartPointEndPoint_3, param=plaza_y_position_parameter)
pointAtParameter_4 = Curve.PointAtParameter(curve=byStartPointEndPoint_4, param=plaza_y_position_parameter)
byStartPointEndPoint_7 = Line.ByStartPointEndPoint(startPoint=pointAtParameter_3, endPoint=pointAtParameter_4)
intersect_2 = Geometry.Intersect(geometry=byStartPointEndPoint_6, other=byStartPointEndPoint_7)
firstItem = List.FirstItem(list=intersect_2)
code_block_7 = CodeBlock(centerPointForPlaza=firstItem) { centerPointForPlaza; }

code_block_8 = CodeBlock(centerPointPlaza=code_block_7) { centerPointPlaza; }

# group: Destination Points
code_block_9 = CodeBlock(boundaryPoints=code_block_4) { boundaryPoints; }
code_block_10 = CodeBlock { 3; }
takeItems = List.TakeItems(list=code_block_9, amount=code_block_10)
code_block_11 = CodeBlock(centerPointForPlaza=code_block_8) { centerPointForPlaza; }
join = List.Join(list0=takeItems, list1=code_block_11)
code_block_12 = CodeBlock(destinationPoints=join) { destinationPoints; }
lastItem = List.LastItem(list=code_block_9)

# group: Visualize Destination Points
code_block_13 = CodeBlock { 0.5; }
byCenterPointRadius = Circle.ByCenterPointRadius(centerPoint=code_block_12, radius=code_block_13)

# group: Boundary Curve
code_block_14 = CodeBlock { true; }
byPoints = PolyCurve.ByPoints(points=code_block_3, connectLastToFirst=code_block_14)
code_block_15 = CodeBlock(boundaryCurve=byPoints) { boundaryCurve; }

# group: Boundary Surface
code_block_16 = CodeBlock(boundaryCurve=code_block_15) { boundaryCurve; }
patch = Curve.Patch(curve=code_block_16)
code_block_17 = CodeBlock(boundarySurface=patch) { boundarySurface; }

# group: Main Road Axis Parameters
y_axis_parameter = DoubleSlider(0.5872224728, range=0..1 step 0.1)  # graph input
x_axis_parameter = DoubleSlider(0.4992707519, range=0..1 step 0.1)  # graph input

# group: Main Road Axis Positions
pointAtParameter_5 = Curve.PointAtParameter(curve=byStartPointEndPoint_5, param=y_axis_parameter)
code_block_18 = CodeBlock(axisParameterY=pointAtParameter_5) { axisParameterY; }
pointAtParameter_6 = Curve.PointAtParameter(curve=byStartPointEndPoint_3, param=x_axis_parameter)
code_block_19 = CodeBlock(axisParameterX=pointAtParameter_6) { axisParameterX; }

# group: Main Roads
code_block_20 = CodeBlock(axisParameterY=code_block_18) { axisParameterY; }
code_block_21 = CodeBlock(centerPointForPlaza=code_block_7) { centerPointForPlaza; }
code_block_22 = CodeBlock(boundaryCurve=code_block_15) { boundaryCurve; }
code_block_23 = CodeBlock(point1=code_block_20, point2=code_block_21, bounds=code_block_22)
# ---------- code_block_23.designscript (2 lines) ----------
// Dynamic X Axis
CreateAxis(point1, point2, bounds);
# ----------------------------------------
code_block_24 = CodeBlock(yAxis=code_block_23) { yAxis; }
code_block_25 = CodeBlock(axisParameterX=code_block_19) { axisParameterX; }
code_block_26 = CodeBlock(point1=code_block_25, point2=code_block_21, bounds=code_block_22)
# ---------- code_block_26.designscript (2 lines) ----------
// Dynamic Y Axis
CreateAxis(point1, point2, bounds);
# ----------------------------------------
code_block_27 = CodeBlock(xAxis=code_block_26) { xAxis; }
code_block_28 = CodeBlock()
# ---------- code_block_28.designscript (8 lines) ----------
def CreateAxis(pt1, pt2, shape) {
	vector1 = Vector.ByTwoPoints(pt1, pt2);
	//Offseting point inside the shape, so that projection goes to the other side of the shape.
	geometry1 = Autodesk.Geometry.Translate(pt1, vector1, 0.1);
	geometry2 = Point.Project(geometry1, shape, vector1);
	line1 = Line.ByStartPointEndPoint(pt1, geometry2);
	return = line1[0];
};
# ----------------------------------------

# group: Split Boundary Using Axes
code_block_29 = CodeBlock(boundarySurface=code_block_17) { boundarySurface; }
code_block_30 = CodeBlock(yAxis=code_block_24) { yAxis; }
split = Geometry.Split(geometry=code_block_29, other=code_block_30)
code_block_31 = CodeBlock(xAxis=code_block_27) { xAxis; }
split_2 = Geometry.Split(geometry=split, other=code_block_31)
flatten_2 = List.Flatten(list=split_2)
code_block_32 = CodeBlock(primaryblocks=flatten_2) { primaryblocks; }

code_block_33 = CodeBlock(centerPointForPlaza=code_block_7) { centerPointForPlaza; }

# group: Create Secondary Roads
code_block_34 = CodeBlock(centerPointForPlaza=code_block_33) { centerPointForPlaza; }
code_block_35 = CodeBlock(boundaryCurve=code_block_15) { boundaryCurve; }
code_block_36 = CodeBlock(primaryblocks=code_block_32) { primaryblocks; }
code_block_37 = CodeBlock { 0.5; }
pointAtParameter_7 = Surface.PointAtParameter(surface=code_block_36, u=code_block_37, v=code_block_37)
byTwoPoints = Vector.ByTwoPoints(start=code_block_34, end=pointAtParameter_7)
project_2 = Point.Project(point=code_block_34, baseGeometry=code_block_35, projectionDirection=byTwoPoints)
flatten_3 = List.Flatten(list=project_2)
byStartPointEndPoint_8 = Line.ByStartPointEndPoint(startPoint=code_block_34, endPoint=flatten_3)
code_block_38 = CodeBlock(secondaryRoads=byStartPointEndPoint_8) { secondaryRoads; }

# group: Split Blocks Using Secondary Roads
code_block_39 = CodeBlock(primaryblocks=code_block_32) { primaryblocks; }
code_block_40 = CodeBlock(secondaryRoads=code_block_38) { secondaryRoads; }
split_3 = Geometry.Split(geometry=code_block_39, other=code_block_40)
flatten_4 = List.Flatten(list=split_3)
code_block_41 = CodeBlock(secondaryBlocks=flatten_4) { secondaryBlocks; }

# group: Main Plaza
code_block_42 = CodeBlock(centerPointForPlaza=code_block_33) { centerPointForPlaza; }
code_block_43 = CodeBlock(yAxis=code_block_24) { yAxis; }
code_block_44 = CodeBlock(xAxis=code_block_27) { xAxis; }
# note: Combine parameters into lists to avoid duplicate sets of nodes
list_create = List.Create(item0=code_block_43, item1=code_block_44)
code_block_45 = CodeBlock(plazaWidth=plaza_width) { plazaWidth; }
code_block_46 = CodeBlock(plazaLength=plaza_length) { plazaLength; }
list_create_2 = List.Create(item0=code_block_45, item1=code_block_46)
parameterAtPoint = Curve.ParameterAtPoint(curve=list_create, point=code_block_42, lacing=Longest)
linear_interpolation = CodeBlock(t=list_create_2, v0=parameterAtPoint) { (1 - t) * v0 + t; }
pointAtParameter_8 = Curve.PointAtParameter(curve=list_create, param=linear_interpolation)
byTwoPoints_2 = Vector.ByTwoPoints(start=code_block_42, end=pointAtParameter_8)
code_block_47 = CodeBlock { 0; 1; }
getItemAtIndex_5 = List.GetItemAtIndex(list=byTwoPoints_2, index=code_block_47.out0)
getItemAtIndex_6 = List.GetItemAtIndex(list=byTwoPoints_2, index=code_block_47.out1)
byOriginVectors = Ellipse.ByOriginVectors(origin=code_block_42, xAxisRadius=getItemAtIndex_5, yAxisRadius=getItemAtIndex_6)
code_block_48 = CodeBlock(plazaCurve=byOriginVectors) { plazaCurve; }

code_block_49 = CodeBlock(plazaCurve=code_block_48) { plazaCurve; }

# group: Remove Plaza Area
code_block_50 = CodeBlock(secondaryBlocks=code_block_41) { secondaryBlocks; }
code_block_51 = CodeBlock(plazaCurve=code_block_49) { plazaCurve; }
code_block_52 = CodeBlock(centerPointForPlaza=code_block_33) { centerPointForPlaza; }
trim = Geometry.Trim(geometry=code_block_50, other=code_block_51, pick=code_block_52)
flatten_5 = List.Flatten(list=trim)
code_block_53 = CodeBlock(adjoiningBlocks=flatten_5) { adjoiningBlocks; }

# group: Offset Initial Blocks For Roads
code_block_54 = CodeBlock(adjoiningBlocks=code_block_53) { adjoiningBlocks; }
perimeterCurves = Surface.PerimeterCurves(surface=code_block_54)
byJoinedCurves = PolyCurve.ByJoinedCurves(curves=perimeterCurves@L2)
code_block_55 = CodeBlock { -0.5; }
offset = Curve.Offset(curve=byJoinedCurves, distance=code_block_55)
code_block_56 = CodeBlock(blockCurves=offset) { blockCurves; }

# group: Filter Blocks Without Buildings
code_block_57 = CodeBlock(blockCurves=code_block_56) { blockCurves; }
byPatch = Surface.ByPatch(closedCurve=code_block_57)
area = Surface.Area(surface=byPatch)
code_block_58 = CodeBlock { 30; }
ge = area >= code_block_58
filterByBoolMask = List.FilterByBoolMask(list=code_block_57, mask=ge)
byPatch_2 = Surface.ByPatch(closedCurve=filterByBoolMask.in)

# group: 2D Buildings
code_block_59 = CodeBlock(occupiedBlocks=filterByBoolMask.in) { occupiedBlocks; }
code_block_60 = CodeBlock { -1.5; }
offset_2 = Curve.Offset(curve=code_block_59, distance=code_block_60)
code_block_61 = CodeBlock { false; }
# note: May fail if not enough room for a building....
clean = List.Clean(list=offset_2, preserveIndices=code_block_61)
code_block_62 = CodeBlock(buildingCurves=clean) { buildingCurves; }
byPatch_3 = Surface.ByPatch(closedCurve=clean)
code_block_63 = CodeBlock(buildingSurfaces=byPatch_3) { buildingSurfaces; }

# group: Building Entrances
join_2 = List.Join()  # unwired: list0, list1
code_block_64 = CodeBlock(buildingCurves=code_block_62) { buildingCurves; }
explode = Geometry.Explode(geometry=code_block_64)
code_block_65 = CodeBlock { 0.2; }
pointAtParameter_9 = Curve.PointAtParameter(curve=explode, param=code_block_65)
normalAtParameter = Curve.NormalAtParameter(curve=explode, param=code_block_65)
code_block_66 = CodeBlock { -0.2; 0.2; }
# note: Translate the entrance in two directions (in the normal to the curve and in the opposite direction from that) and test which points are inside vs. outside the building. Use the boolmask of the ones outside to filter the list of entrance points (both on the building curves and offset by 0.2m).
translate = Geometry.Translate(geometry=pointAtParameter_9, direction=normalAtParameter, distance=code_block_66.out0, lacing=Longest)
code_block_67 = CodeBlock(buildingSurfaces=code_block_63) { buildingSurfaces; }
doesIntersect = Geometry.DoesIntersect(geometry=translate, other=code_block_67)
filterByBoolMask_2 = List.FilterByBoolMask(list=translate, mask=doesIntersect)
translate_2 = Geometry.Translate(geometry=pointAtParameter_9, direction=normalAtParameter, distance=code_block_66.out1, lacing=Longest)
doesIntersect_2 = Geometry.DoesIntersect(geometry=translate_2, other=code_block_67)
filterByBoolMask_3 = List.FilterByBoolMask(list=translate_2, mask=doesIntersect_2)
combine = List.Combine(comb=join_2, list1=filterByBoolMask_2.out, list2=filterByBoolMask_3.out)
code_block_68 = CodeBlock(offsetEntrances=combine) { offsetEntrances; }
filterByBoolMask_4 = List.FilterByBoolMask(list=pointAtParameter_9, mask=doesIntersect)
filterByBoolMask_5 = List.FilterByBoolMask(list=pointAtParameter_9, mask=doesIntersect_2)
combine_2 = List.Combine(comb=join_2, list1=filterByBoolMask_4.out, list2=filterByBoolMask_5.out)
code_block_69 = CodeBlock(pointsOnBuildingCurve=combine_2) { pointsOnBuildingCurve; }

# group: Visualize Building Entrances
code_block_70 = CodeBlock { 0.2; }
byCenterPointRadius_2 = Circle.ByCenterPointRadius(centerPoint=code_block_68, radius=code_block_70)

code_block_71 = CodeBlock(buildingCurves=code_block_62) { buildingCurves; }
code_block_72 = CodeBlock(buildingSurfaces=code_block_63) { buildingSurfaces; }

# group: 3D Buildings
code_block_73 = CodeBlock(buildingCurves=code_block_71) { buildingCurves; }
ZAxis_2 = Vector.ZAxis()
code_block_74 = CodeBlock(buildingSurfaces=code_block_72) { buildingSurfaces; }
area_2 = Surface.Area(surface=code_block_74)
code_block_75 = CodeBlock(a=area_2) { Math.Min(6.0, Math.Sqrt(200/a)); }
extrudeAsSolid = Curve.ExtrudeAsSolid(curve=code_block_73, direction=ZAxis_2, distance=code_block_75)
code_block_76 = CodeBlock(buildingShells=extrudeAsSolid) { buildingShells; }
code_block_77 = CodeBlock(buildingHeights=code_block_75) { buildingHeights; }
count = List.Count(list=extrudeAsSolid)
code_block_78 = CodeBlock(buildingCount=count) { buildingCount; }

# group: Visualize 3D Buildings
color_palette_5 = ColorPalette({R: 0, G: 191, B: 255, A: 190})
byGeometryColor_5 = Modifiers.GeometryColor.ByGeometryColor(geometry=code_block_76, color=color_palette_5)

# group (continued): Filter Blocks Without Buildings
isNull = Object.IsNull(obj=offset_2)
filterByBoolMask_6 = List.FilterByBoolMask(list=byPatch_2, mask=isNull)
code_block_79 = CodeBlock(occupiedBlockSurfaces=filterByBoolMask_6.out) { occupiedBlockSurfaces; }
filterByBoolMask_7 = List.FilterByBoolMask(list=filterByBoolMask.in, mask=isNull)
code_block_80 = CodeBlock(occupiedBlockCurves=filterByBoolMask_7.out) { occupiedBlockCurves; }
join_3 = List.Join(list0=filterByBoolMask.out, list1=filterByBoolMask_7.in, list2=filterByBoolMask_6.in)
code_block_81 = CodeBlock(emptyBlockCurves=join_3) { emptyBlockCurves; }

# group: Paths to Doors
code_block_82 = CodeBlock(entrancePoints=code_block_69) { entrancePoints; }
code_block_83 = CodeBlock(occupiedBlockCurves=code_block_80) { occupiedBlockCurves; }
code_block_84 = CodeBlock(offsetEntrances=code_block_68) { offsetEntrances; }
byTwoPoints_3 = Vector.ByTwoPoints(start=code_block_82, end=code_block_84)
project_3 = Point.Project(point=code_block_82, baseGeometry=code_block_83, projectionDirection=byTwoPoints_3)
code_block_85 = CodeBlock { 0.5; }
translate_3 = Geometry.Translate(geometry=project_3, direction=byTwoPoints_3, distance=code_block_85)
byStartPointEndPoint_9 = Line.ByStartPointEndPoint(startPoint=code_block_82, endPoint=translate_3)
length = Curve.Length(curve=byStartPointEndPoint_9)
code_block_86 = CodeBlock { 5; }
lt = length < code_block_86
filterByBoolMask_8 = List.FilterByBoolMask(list=byStartPointEndPoint_9, mask=lt)
code_block_87 = CodeBlock { 0.5; }
ZAxis_3 = Vector.ZAxis()
byThickeningCurve = PolyCurve.ByThickeningCurve(curve=filterByBoolMask_8.in, thickness=code_block_87, nor=ZAxis_3)
ZAxis_4 = Vector.ZAxis()
code_block_88 = CodeBlock { 0.1; }
extrudeAsSolid_2 = Curve.ExtrudeAsSolid(curve=byThickeningCurve, direction=ZAxis_4, distance=code_block_88)
code_block_89 = CodeBlock { -0.05; }
translate_4 = Geometry.Translate(geometry=extrudeAsSolid_2, direction=ZAxis_4, distance=code_block_89)
code_block_90 = CodeBlock { false; }
clean_2 = List.Clean(list=translate_4, preserveIndices=code_block_90)
byUnion = Solid.ByUnion(solids=clean_2@L3)
byUnion_2 = Solid.ByUnion(solids=byUnion)

# group: Forecourt Areas
code_block_91 = CodeBlock(occupiedBlockSurfaces=code_block_79) { occupiedBlockSurfaces; }
subtractFrom = Surface.SubtractFrom(surface=code_block_91, trimmingEntity=code_block_76)
flatten_6 = List.Flatten(list=subtractFrom)
code_block_92 = CodeBlock(buildingPaths=byUnion_2) { buildingPaths; }
subtractFrom_2 = Surface.SubtractFrom(surface=flatten_6, trimmingEntity=code_block_92)
explode_2 = Geometry.Explode(geometry=subtractFrom_2)
perimeterCurves_2 = Surface.PerimeterCurves(surface=explode_2)
explode_3 = Geometry.Explode(geometry=code_block_81)
join_4 = List.Join(list0=perimeterCurves_2, list1=explode_3)
code_block_93 = CodeBlock(forecourtCurves=join_4) { forecourtCurves; }
code_block_94 = CodeBlock(emptyBlockCurves=code_block_81) { emptyBlockCurves; }
byPatch_4 = Surface.ByPatch(closedCurve=code_block_94)
join_5 = List.Join(list0=subtractFrom_2, list1=byPatch_4)
code_block_95 = CodeBlock(forecourtSurfaces=join_5) { forecourtSurfaces; }

# group: Lattice For Space Analysis
code_block_96 = CodeBlock(boundaryCurve=code_block_15) { boundaryCurve; }
# note: Offset boundary by the grid resolution to prevent rounding errors.
code_block_97 = CodeBlock { 0.2; }
offset_3 = Curve.Offset(curve=code_block_96, distance=code_block_97)
boundingBox = Geometry.BoundingBox(geometry=offset_3)
code_block_98 = CodeBlock(buildingCurves=code_block_71) { buildingCurves; }
code_block_99 = CodeBlock(forecourtCurves=code_block_93) { forecourtCurves; }
join_6 = List.Join(list0=code_block_98, list1=code_block_99)
flatten_7 = List.Flatten(list=join_6)
approximateCurvesWithLines = Custom[Utils.ApproximateCurvesWithLines](curves=flatten_7)  # Approximate Curves With Lines
byBoundingBoxAndLines = Core.SpaceLattice.ByBoundingBoxAndLines(boundingBox=boundingBox, barriers=approximateCurvesWithLines, resolution=code_block_97)
code_block_100 = CodeBlock(lattice=byBoundingBoxAndLines) { lattice; }

# group: Adjacency Metric (Minimize)
code_block_101 = CodeBlock(destinationPoints=code_block_12) { destinationPoints; }
bySpaceLatticeAndEndPoint = Pathfinding.PathField.BySpaceLatticeAndEndPoint(spaceLattice=code_block_100, endPoint=code_block_101)
code_block_102 = CodeBlock(buildingEntrances=code_block_68) { buildingEntrances; }
byPathField = Pathfinding.Route.ByPathField(pathField=bySpaceLatticeAndEndPoint, otherPoint=code_block_102, lacing=CrossProduct)
code_block_103 = CodeBlock { 8; }
curve = Pathfinding.Route.Curve(route=byPathField, tidyIterations=code_block_103)

flatten_8 = List.Flatten(list=curve)

# group (continued): Adjacency Metric (Minimize)
code_block_104 = CodeBlock(paths=flatten_8) { paths; }
length_2 = Curve.Length(curve=code_block_104)
average = Math.Average(numbers=length_2)
adjacency = Watch(average)  # graph output

# group: Visualize Adjacency Paths
color_palette_6 = ColorPalette({R: 206, G: 0, B: 146, A: 165})
byGeometryColor_6 = Modifiers.GeometryColor.ByGeometryColor(geometry=code_block_104, color=color_palette_6)

# group: Forecourts Area
code_block_105 = CodeBlock(forecourts=code_block_95) { forecourts; }
area_3 = Surface.Area(surface=code_block_105)
flatten_9 = List.Flatten(list=area_3)
sum = Math.Sum(values=flatten_9)
forecourt_area = Watch(sum)  # graph output

code_block_106 = CodeBlock(plazaCurve=code_block_49) { plazaCurve; }

# group: Plaza Area
code_block_107 = CodeBlock(plazaCurve=code_block_106) { plazaCurve; }
byPatch_5 = Surface.ByPatch(closedCurve=code_block_107)
code_block_108 = CodeBlock(a=byPatch_5) { a[0][0]; }
area_4 = Surface.Area(surface=code_block_108)
plaza_area = Watch(area_4)  # graph output

# group: Visualize Forecourts
color_palette_7 = ColorPalette({R: 89, G: 200, B: 89, A: 205})
byGeometryColor_7 = Modifiers.GeometryColor.ByGeometryColor(geometry=code_block_95, color=color_palette_7)

# group: Building Area
area_5 = Surface.Area(surface=code_block_72)
sum_2 = Math.Sum(values=area_5)
building_area = Watch(sum_2)  # graph output

# group: Percentage of Existing Trees Saved (Maximize)
code_block_109 = CodeBlock(boundarySurface=code_block_17) { boundarySurface; }
code_block_110 = CodeBlock(trees=code_block) { trees; }
intersect_3 = Geometry.Intersect(geometry=code_block_109, other=code_block_110, lacing=CrossProduct)
code_block_111 = CodeBlock { false; }
clean_3 = List.Clean(list=intersect_3, preserveIndices=code_block_111)
flatten_10 = List.Flatten(list=clean_3)
code_block_112 = CodeBlock(forecourtsSurfaces=code_block_95) { forecourtsSurfaces; }
code_block_113 = CodeBlock(plazaCurve=code_block_106) { plazaCurve; }
# note: The trees that are within main plaza and forecourts will be kept.
byPatch_6 = Surface.ByPatch(closedCurve=code_block_113)
join_7 = List.Join(list0=code_block_112, list1=byPatch_6)
flatten_11 = List.Flatten(list=join_7)
doesIntersect_3 = Geometry.DoesIntersect(geometry=flatten_11, other=flatten_10, lacing=CrossProduct)
countTrue = List.CountTrue(list=doesIntersect_3)
code_block_114 = CodeBlock(trees=flatten_10, treesSaved=countTrue) { totalTrees = List.Count(trees); percentOfTreesSaved = (treesSaved / totalTrees) * 100; }
percentage_trees_saved = Watch(code_block_114.percentOfTreesSaved)  # graph output

# group: Program Cost & Revenue
code_block_115 = CodeBlock()
# ---------- code_block_115.designscript (8 lines) ----------
residentialCost = 1000;
residentialCevenue = 100;

academicCost = 1000;
academicRevenue = 10;

retailCost = 1100;
retailRevenue = 300;
# ----------------------------------------

# group: Floors
code_block_116 = CodeBlock(buildingSurfaces=code_block_72) { buildingSurfaces; }
code_block_117 = CodeBlock(buildingHeights=code_block_77) { buildingHeights; }
code_block_118 = CodeBlock(h=code_block_117) { 0..h..0.4; }
translate_5 = Geometry.Translate(geometry=code_block_116, zTranslation=code_block_118)
count_2 = List.Count(list=code_block_118@L2)
code_block_119 = CodeBlock(floors=count_2) { floors; }
code_block_120 = CodeBlock(x=code_block_119) { Math.Floor(x/4); }
chop = List.Chop(list=translate_5@L2, lengths=code_block_120, lacing=Longest)
# note: Currently We have hardcoded 1:2:1 ratio of Retail:Academic:Residential floors
code_block_121 = CodeBlock(t2=chop)
# ---------- code_block_121.designscript (5 lines) ----------
retailFloors = List.GetItemAtIndex(t2@L3<1>, 0);
academicFloors1 = List.GetItemAtIndex(t2@L3<1>, 1);
academicFloors2 = List.GetItemAtIndex(t2@L3<1>, 2);
academicFloors = List.Join([academicFloors1, academicFloors2]);
residentialFloors = List.GetItemAtIndex(t2@L3<1>, 3);
# ----------------------------------------
code_block_122 = CodeBlock(retailFloors=code_block_121.retailFloors) { retailFloors; }
code_block_123 = CodeBlock(academicFloors=code_block_121.academicFloors) { academicFloors; }
code_block_124 = CodeBlock(residentialFloors=code_block_121.residentialFloors) { residentialFloors; }

# group: Cost & Profit
code_block_125 = CodeBlock(residentialCost=code_block_115.residentialCost, residentialRevenue=code_block_115.residentialCevenue, academicCost=code_block_115.academicCost, academicRevenue=code_block_115.academicRevenue, retailCost=code_block_115.retailCost, retailRevenue=code_block_115.retailRevenue) { residentialCost; residentialRevenue; academicCost; academicRevenue; retailCost; retailRevenue; }
code_block_126 = CodeBlock(retailFloors=code_block_122) { retailFloors; }
area_6 = Surface.Area(surface=code_block_126)
flatten_12 = List.Flatten(list=area_6)
sum_3 = Math.Sum(values=flatten_12)
code_block_127 = CodeBlock(academicFloors=code_block_123) { academicFloors; }
area_7 = Surface.Area(surface=code_block_127)
flatten_13 = List.Flatten(list=area_7)
sum_4 = Math.Sum(values=flatten_13)
code_block_128 = CodeBlock(residentialFloors=code_block_124) { residentialFloors; }
area_8 = Surface.Area(surface=code_block_128)
flatten_14 = List.Flatten(list=area_8)
sum_5 = Math.Sum(values=flatten_14)
code_block_129 = CodeBlock(r_cost_sf=code_block_125.retailCost, r_sf=sum_3, a_cost_sf=code_block_125.academicCost, a_sf=sum_4, res_cost_sf=code_block_125.residentialCost, res_sf=sum_5)
# ---------- code_block_129.designscript (4 lines) ----------
r_cost = r_cost_sf * r_sf;
a_cost = a_cost_sf * a_sf;
res_cost = res_cost_sf * res_sf;
cost = r_cost + a_cost + res_cost;
# ----------------------------------------
building_cost = Watch(code_block_129.cost)  # graph output
code_block_130 = CodeBlock(r_rev_sf=code_block_125.retailRevenue, r_sf=sum_3, a_rev_sf=code_block_125.academicRevenue, a_sf=sum_4, res_rev_sf=code_block_125.residentialRevenue, res_sf=sum_5) { r_rev = r_rev_sf * r_sf; a_rev = a_rev_sf * a_sf; res_rev = res_rev_sf * res_sf; rev = r_rev + a_rev + res_rev; }
profit_per_year = Watch(code_block_130.rev)  # graph output
div = building_cost / profit_per_year
number_of_years_to_payback = Watch(div)  # graph output

# group: Visualize Academic Floors
color_palette_8 = ColorPalette({R: 255, G: 127, B: 80, A: 255})
byGeometryColor_8 = Modifiers.GeometryColor.ByGeometryColor(geometry=code_block_121.academicFloors, color=color_palette_8)

# group: Visualize Retail Floors
color_palette_9 = ColorPalette({R: 0, G: 255, B: 255, A: 255})
byGeometryColor_9 = Modifiers.GeometryColor.ByGeometryColor(geometry=code_block_121.retailFloors, color=color_palette_9)

# group: Visualize Residential Floors
color_palette_10 = ColorPalette({R: 100, G: 149, B: 237, A: 255})
byGeometryColor_10 = Modifiers.GeometryColor.ByGeometryColor(geometry=code_block_121.residentialFloors, color=color_palette_10)

# group: Building Count
building_count = Watch(code_block_78)  # graph output

# group: Building Volume Deviation
code_block_131 = CodeBlock(buildingShells=code_block_76) { buildingShells; }
volume = Solid.Volume()  # unwired: solid
map = List.Map(list=code_block_131, f_x=volume)
python_script = Python(IN[0]=map)
# ---------- python_script.python (18 lines) ----------
import math

def shifted_data_variance(data):
   if len(data) < 2:
      return 0.0
   K = data[0]
   n = Ex = Ex2 = 0.0
   for x in data:
      n = n + 1
      Ex += x - K
      Ex2 += (x - K) * (x - K)
   variance = (Ex2 - (Ex * Ex)/n)/n
   return variance

def std_dev(data):
	return math.sqrt(shifted_data_variance(data))

OUT = std_dev(IN[0])
# ----------------------------------------
building_volume_deviation = Watch(python_script)  # graph output

# group: Balance
code_block_132 = CodeBlock(count=building_count, deviation=building_volume_deviation) { 100 * count / deviation; }
balance = Watch(code_block_132)  # graph output
